# Grasshopper definition 101_primitives_and_subdivisions_ex.ghx (Grasshopper 1.0.8)

py3 = Python3Script(radius=Slider(4, range=0..100), num_sides=Slider(10, range=0..10))  # -> out, new_mesh_rhino; inputs radius: Double, num_sides: Int32; unedited script template
geo = Geometry(py3.new_mesh_rhino)

# ----
# mesh from scratch
panel = Panel("C:\Users\user\github")
py3_2 = Python3Script(mola_path=panel)  # -> out, a; inputs mola_path: String
# ---------- py3_2: Python ----------
import sys

if mola_path not in sys.path:
    sys.path.append(mola_path)

print(sys.path)

try:
    import mola
    from mola import module_rhino
except ImportError as e:
    print("Error importing mola: {e}")
# ---------- end py3_2 ----------

number_slider = Slider(5, range=0..10)
number_slider_2 = Slider(-7, range=-10..10)
# primitives
py3_3 = Python3Script(x=number_slider, y=number_slider, z=number_slider, x1=number_slider_2, y1=number_slider_2, z1=number_slider_2)  # -> out, my_mesh, my_mesh_rhino; unedited script template
# subdivision
py3_4 = Python3Script(mesh=py3_3.my_mesh, r=Slider(3, range=0..10))  # -> out, new_mesh, my_mesh_rhino; inputs r: Int32; unedited script template
py3_5 = Python3Script(mesh=py3_4.new_mesh)  # -> out, new_mesh, my_mesh_rhino; unedited script template

py3_6 = Python3Script(r=Slider(5, range=0..10))  # -> out, new_mesh, my_mesh_rhino; inputs r: Int32
# ---------- py3_6: Python ----------
import mola
from mola import module_rhino

my_mesh = mola.construct_sphere(r,3,3)

for v in my_mesh.vertices:
    if v.z>0:
        v.z *= 1.5

my_mesh = mola.subdivide_mesh_catmull(my_mesh)

my_properties = my_mesh.face_properties(mola.face_center_z)


mola.color_faces_by_vertical_angle(my_mesh.faces)

heights = mola.math_map_list(my_properties, 0.0, 2.0)

new_mesh = mola.Mesh()
for i, f in enumerate(my_mesh.faces):
    if heights[i] > 0.5:
        doCap = False
    else: 
        doCap = True
    resulting_faces = mola.subdivide_face_extrude_tapered(f, heights[i], 0.6, doCap)
    new_mesh.faces.extend(resulting_faces)

new_mesh.update_topology()
new_mesh = mola.mesh_offset(new_mesh,0.2)

for i in range(1):
    new_mesh = mola.subdivide_mesh_catmull(new_mesh)

props = new_mesh.face_properties(mola.face_center_z)
color_scheme = [(0,0,1),(1,0,1), (0.5,0.5,0.5), (1,1,1)]
colors = mola.color_map(props , color_scheme)
mola.color_faces_by_map(new_mesh.faces,colors)


new_mesh.update_topology()
my_mesh_rhino = module_rhino.display_mesh(new_mesh)
# ---------- end py3_6 ----------
geo_2 = Geometry(py3_6.my_mesh_rhino)
