# Grasshopper definition 102_two_sticks.gh (Grasshopper 1.0.8)

line_0 = Curve(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)
line_1 = Curve(<curve referenced from the Rhino model>)
py3 = Python3Script(line_0=line_0, line_1=line_1)  # -> out, sticks; inputs line_0: Line, line_1: Line
# ---------- py3: Python ----------
#locate stick class file in the same folder
from compas_rhino import unload_modules
import sys
import os

#get current file path
path = ghenv.Component.OnPingDocument().FilePath
#get parent directory of the parent directory
parentdir = os.path.dirname(path)
#get src folder which contains classes
dire = os.path.join(parentdir,'scripts')

sys.path.append(dire)


unload_modules('stick')

import stick
from stick import Stick
from compas.geometry import Line, Point, Vector
from compas_rhino.conversions import line_to_compas
# ---------- end py3 ----------
draw = COMPASDraw(cg=py3.sticks)  # -> rg
#   port cg: The COMPAS geometry or datastructure to be drawn.
#   port rg: The Rhino geometry object.
# ---------- draw: Python ----------
# r: compas>=2.14.1
"""
Draws COMPAS geometry in Grasshopper.
"""

from typing import Any

import Grasshopper

from compas.scene import SceneObject


class CompasToRhinoGeometry(Grasshopper.Kernel.GH_ScriptInstance):
    def RunScript(self, cg):
        if not cg:
            return None

        return SceneObject(item=cg).draw()
# ---------- end draw ----------
