# Grasshopper definition 103_branching_out_sticks.ghx (Grasshopper 1.0.8)

xy_plane = XYPlane(Origin=Point(0, 0, 0))
python_3_script = Python3Script(root=xy_plane, stick_length=Slider(290.1, range=0..1000))  # -> out, geometries; inputs root: Plane
# ---------- python_3_script: Python ----------
# r: compas>=2.14.1
# venv: sticks

import sys
import os
import math

#get current file path
path = ghenv.Component.OnPingDocument().FilePath
print (path)
#get parent directory of the parent directory
parentdir = os.path.dirname(path)
print (parentdir)
#get src folder which contains classes
dire = os.path.join(parentdir,'scripts')
print (dire)

sys.path.append(dire)

from compas_rhino import unload_modules

unload_modules("Sticks")
unload_modules("stick_module")

import Sticks
from Sticks import Stick 
from stick_module import BranchingModule
from compas.geometry import Line, Point, Vector, Frame

stick_width = 13.0
stick_depth = 13.0

from compas_rhino.conversions import plane_to_compas_frame, frame_to_rhino_plane

# Convert input to compas
root = plane_to_compas_frame(root)
print(root)

# Initialize tree
tree = BranchingModule(root, stick_length=200, width = stick_width, depth = stick_depth)

# Grow tree
tree.grow_stick(face_index = 0, angle = 0.1)
tree.grow_stick(face_index = 1, angle = 0.5)
tree.grow_stick(face_index = 2, angle = 0.2)
tree.grow_stick(face_index = 3, angle = 0.5)
tree.grow_stick(from_stick_index = 0, face_index = 2, angle = -0.1)

# Visualize
geometries = tree.visualize()

frames = [stick.frame for stick in tree.sticks]
# ---------- end python_3_script ----------
py3 = Python3Script(
    x_range=Slider(5, range=0..10),
    y_range=Slider(5, range=0..10),
    z_range=Slider(5, range=0..10),
    offset_x=Slider(2, range=0..100),
    offset_y=Slider(2, range=0..100))  # -> out, sticks, my_points, polylines; inputs x_range: Int32, y_range: Int32, z_range: Int32, offset_x: Double, offset_y: Double
# ---------- py3: Python ----------
#locate stick class file in the same folder
from compas_rhino import unload_modules
import sys
import os
import math

#get current file path
path = ghenv.Component.OnPingDocument().FilePath
#get parent directory of the parent directory
parentdir = os.path.dirname(path)
#get src folder which contains classes
dire = os.path.join(parentdir,'scripts')

sys.path.append(dire)


unload_modules('Sticks')
unload_modules('stick_module')
unload_modules('nadja_test')

import Sticks
import nadja_test
from stick_module import BranchingModule
from nadja_test import Planarize
from compas.geometry import Line, Point, Vector, Polyline
from compas_rhino.conversions import line_to_compas, point_to_compas
from ghpythonlib.treehelpers import list_to_tree, tree_to_list

stick_length = 2
stick_width = .13
stick_depth = .13

points = []
assembly = []

for z in range(z_range):
    row = []
    for x in range(x_range):
        grid_size_x = stick_length - 2*stick_depth + offset_x
        grid_size = stick_length - 2*stick_depth
        grid_size_z = stick_length - 2*stick_depth + offset_y
        pt = Point(x * grid_size_x, grid_size, z * grid_size_z)
        row.append(pt)
    points.append(row)




### make this like it is a class
### function of the class: to planarize all the points 
pol_pt = []

for i in range(z_range-1):
    i = i % z_range
    pol_points = []
    for j in range(x_range-1):
        j = j % x_range
        p0 = points[i][j]
        p1 = points[i][j+1]
        p3 = points[i+1][j]
        p2 = points[i+1][j+1]
        pol_points.append([p0, p1, p2, p3, p0])
    
    pol_pt.append(pol_points)


module = Planarize(pol_pt)
polylines = module.create_polygon()


my_points = list_to_tree(points)


# sticks = [s.geometry for s in assembly]
# ---------- end py3 ----------
draw = COMPASDraw(cg=python_3_script.geometries)  # -> rg
#   port cg: The COMPAS geometry or datastructure to be drawn.
#   port rg: The Rhino geometry object.
# ---------- draw: Python ----------
# r: compas>=2.14.1
"""
Draws COMPAS geometry in Grasshopper.
"""

from typing import Any

import Grasshopper

from compas.scene import SceneObject


class CompasToRhinoGeometry(Grasshopper.Kernel.GH_ScriptInstance):
    def RunScript(self, cg):
        if not cg:
            return None

        return SceneObject(item=cg).draw()
# ---------- end draw ----------
draw_2 = COMPASDraw(cg=py3.polylines)  # -> rg; same code as draw
draw_3 = COMPASDraw(cg=py3.my_points)  # -> rg; same code as draw
draw_4 = COMPASDraw(cg=py3.sticks)  # -> rg; same code as draw
points = PointList(Points=draw_3, Size="1")
swatch = ColourSwatch(SwatchColor=RGB(255, 255, 255))
material = CreateMaterial(Diffuse=ColourSwatch(SwatchColor=RGB(0, 0, 0)), Specular=swatch, Emission=swatch, Transparency=0, Shine=0)
preview = CustomPreview(Geometry=draw_4, Material=material)
