# Grasshopper definition 25 27 11 (nadja).gh (Grasshopper 1.0.8)

number_slider = Slider(3, range=-90..90)  # disabled
number_slider_2 = Slider(-68, range=-90..90)  # disabled
number_slider_3 = Slider(-62, range=-90..90)
number_slider_4 = Slider(45, range=-90..90)

# ---- group: Tamplate
py3 = Python3Script()  # -> out, a
# ---------- py3: Python ----------
# r: compas>=2.14.1
# venv: sticks

import sys
import os
import math

#get current file path
path = ghenv.Component.OnPingDocument().FilePath
print (path)
#get parent directory of the parent directory
parentdir = os.path.dirname(path)
print (parentdir)
#get src folder which contains classes
dire = os.path.join(parentdir,'group_one_scripts')
print (dire)

sys.path.append(dire)

from compas_rhino import unload_modules

unload_modules("group_one_sticks")
unload_modules("group_one_stick_module")
unload_modules("nadja_test")

import group_one_sticks
import nadja_test

from group_one_sticks import Stick 
from group_one_stick_module import BranchingModule
from nadja_test import Planarize
from compas.geometry import Line, Point, Vector, Frame
# ---------- end py3 ----------

# ----
number_slider_5 = Slider(10, range=0..100)  # disabled
# first test one row
panel = Panel("{0,0,0}")  # disabled
merge = Merge(Data1=number_slider_3, Data2=number_slider_4)
merge_2 = Merge(Data1=number_slider, Data2=number_slider_2)  # disabled
pt = Point(panel)  # disabled
pt_2 = Point("{0,0,0}")
line_1 = Curve(<curve referenced from the Rhino model>)  # disabled
panel_2 = Panel(".2")  # disabled
crv = Curve([<curve referenced from the Rhino model> x16])
crv_2 = Curve([<curve referenced from the Rhino model> x16])  # disabled
line_0 = Curve(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)  # disabled
crv_3 = Curve([<curve referenced from the Rhino model> x4])  # disabled
crv_4 = Curve([<curve referenced from the Rhino model> x38])

# ---- group: module
py3_2 = Python3Script(
    root_point=pt_2,
    x_range=Slider(10, range=0..100),
    angles=merge,
    angle_x=number_slider_4,
    angle_z=number_slider_3,
    translation_bottom=Slider(2, range=0..10),
    translation_top=Slider(2, range=0..10),
    heigth=Slider(2, range=0..10))  # -> out, sticks, my_points, v_x, face_plane, all_points; inputs root_point: Point3d, x_range: Int32, angles: list of Double, angle_x: Double, angle_z: Double, translation_bottom: Double, translation_top: Double, heigth: Double
# ---------- py3_2: Python ----------
# r: compas>=2.14.1
# venv: sticks

import sys
import os
import math

#get current file path
path = ghenv.Component.OnPingDocument().FilePath
print (path)
#get parent directory of the parent directory
parentdir = os.path.dirname(path)
print (parentdir)
#get src folder which contains classes
dire = os.path.join(parentdir,'group_one_scripts')
print (dire)

sys.path.append(dire)

from compas_rhino import unload_modules

unload_modules("group_one_sticks")
unload_modules("group_one_stick_module")
unload_modules("nadja_studies")

import group_one_sticks
import nadja_studies

from group_one_sticks import Stick 
from group_one_stick_module import BranchingModule
from nadja_studies import Planarize
from compas.geometry import Line, Point, Vector, Frame
from compas_rhino.conversions import line_to_compas, point_to_compas
from ghpythonlib.treehelpers import list_to_tree, tree_to_list

stick_length = translation_bottom
stick_width = .13
stick_depth = .13

# STEP 1: convert rg.Point3d to compas point
root = point_to_compas(root_point)

# STEP 2: class of the planirire
planar = Planarize(root, translation_bottom, translation_top, heigth, angles)
planar.initial_face(angle_x, angle_z)

# STEP 3: initial face
v_x = planar.initial_face_points
face_plane = planar.initial_face_plane # when it is a property it does not need this = ()

# STEP 4: adding rows 
point_list = planar.row_faces(x_range, angles=angles)
column_points = planar.initial_column_faces(x_range, angles=angles)

all_points = planar.column_faces()
    
# STEP 5: make lines for sticks
stick_lines = planar.module_stick()
  
# STEP 6: list to tree
my_points = list_to_tree(stick_lines) 

# STEP 7: sticks class

sticks = [Stick(s, width = stick_width, depth = stick_depth).geometry for s in stick_lines]


# sticks = [s.geometry for s in stick_lines]
# ---------- end py3_2 ----------

py3_3 = Python3Script(root_point=pt, x_range=number_slider_5, angles=merge_2, angle_x=number_slider_2, angle_z=number_slider)  # -> out, sticks, my_points, v_x, face_plane, all_points; inputs root_point: Point3d, x_range: Int32, angles: list of Double, angle_x: Double, angle_z: Double; disabled
# ---------- py3_3: Python ----------
# r: compas>=2.14.1
# venv: sticks

import sys
import os
import math

#get current file path
path = ghenv.Component.OnPingDocument().FilePath
print (path)
#get parent directory of the parent directory
parentdir = os.path.dirname(path)
print (parentdir)
#get src folder which contains classes
dire = os.path.join(parentdir,'group_one_scripts')
print (dire)

sys.path.append(dire)

from compas_rhino import unload_modules

unload_modules("group_one_sticks")
unload_modules("group_one_stick_module")
unload_modules("nadja_test")

import group_one_sticks
import nadja_test

from group_one_sticks import Stick 
from group_one_stick_module import BranchingModule
from nadja_test import Planarize
from compas.geometry import Line, Point, Vector, Frame
from compas_rhino.conversions import line_to_compas, point_to_compas
from ghpythonlib.treehelpers import list_to_tree, tree_to_list

stick_length = 2
stick_width = .13
stick_depth = .13

# convert rg.Point3d to compas point
root = point_to_compas(root_point)

# class of the planirire
planar = Planarize(root)
planar.initial_face(angle_x, angle_z)

# initial face
v_x = planar.initial_face_points
face_plane = planar.initial_face_plane # when it is a property it does not need this = ()

# adding rows 
point_list = planar.row_faces(x_range, angles=angles)
column_points = planar.initial_column_faces(x_range, angles=angles)

all_points = planar.column_faces()
print(all_points)

# adding columns 
# point_list = planar.column_faces(x_range, angles=angles)
# print(point_list)

    
# list to tree
my_points = list_to_tree(all_points) 




# points = []
# assembly = []

# for z in range(z_range):
#     row = []
#     for x in range(x_range):
#         grid_size_x = stick_length - 2*stick_depth + offset_x
#         grid_size = stick_length - 2*stick_depth
#         grid_size_z = stick_length - 2*stick_depth + offset_y
#         pt = Point(x * grid_size_x, grid_size, z * grid_size_z)
#         row.append(pt)
#     points.append(row)




# ### make this like it is a class
# ### function of the class: to planarize all the points 
# pol_pt = []
# polylines = []

# for i in range(z_range-1):
#     i = i % z_range
#     pol_points = []
#     for j in range(x_range-1):
#         j = j % x_range
#         p0 = points[i][j]
#         p1 = points[i][j+1]
#         p3 = points[i+1][j]
#         p2 = points[i+1][j+1]
#         pol_points.append([p0, p1, p2, p3, p0])
    
#     pol_pt.append(pol_points)

# for p_list in pol_pt:
#     for p in p_list:
#         pol = Polyline(p)
#         polylines.append(pol)


# # sticks = [s.geometry for s in assembly]
# ---------- end py3_3 ----------

# ----
cpoly = ControlPolygon(Curve=crv)  # -> Polygon, Points
cpoly_2 = ControlPolygon(Curve=crv_2)  # -> Polygon, Points; disabled
py3_4 = Python3Script(lines=crv)  # -> out, my_points, planes, projected_crvs, centroids, my_vectors; inputs lines: list of Polyline
# ---------- py3_4: Python ----------
#locate stick class file in the same folder
from compas_rhino import unload_modules
import sys
import os
import math

import Rhino.Geometry as rg
from ghpythonlib.treehelpers import list_to_tree, tree_to_list
# ---------- end py3_4 ----------
py3_5 = Python3Script(line_0=line_0, line_1=line_1, lines=crv_3, width=panel_2, depth=panel_2)  # -> out, stick_box, sticks; inputs line_0: Line, line_1: Line, lines: list of Line, width: Double, depth: Double; disabled
# ---------- py3_5: Python ----------
#locate stick class file in the same folder
from compas_rhino import unload_modules
import sys
import os
import math

#get current file path
path = ghenv.Component.OnPingDocument().FilePath
#get parent directory of the parent directory
parentdir = os.path.dirname(path)
#get src folder which contains classes
dire = os.path.join(parentdir,'sticks')

sys.path.append(dire)


unload_modules('Sticks')

import Sticks
from Sticks import Stick, stick_bridge
from compas.geometry import Line, Point, Vector
from compas_rhino.conversions import line_to_compas

assembly = []
line0 = line_to_compas(line_0)

#initiates a class Stick named stick0
stick0 = Stick(line0)
# stick0.rotate_stick(0)
assembly.append(stick0)

line1 = line_to_compas(line_1)
stick1 = Stick(line1)
# stick1.rotate_stick(0, Vector(0,1,0), stick1.axis.start)
assembly.append(stick1)


stick2 = stick_bridge(stick0, stick1)
assembly.append(stick2)


for line in lines:
    compas_line = line_to_compas(line)
    stick = Stick(compas_line, width, depth)
    assembly.append(stick)


# generates geometry of the stick0 class: Box
sticks = [s.geometry for s in assembly]
# ---------- end py3_5 ----------
py3_6 = Python3Script(lines=crv_4, width=".2", depth=".2")  # -> out, stick_box, sticks; inputs lines: list of Line, width: Double, depth: Double
# ---------- py3_6: Python ----------
#locate stick class file in the same folder
from compas_rhino import unload_modules
import sys
import os
import math

#get current file path
path = ghenv.Component.OnPingDocument().FilePath
#get parent directory of the parent directory
parentdir = os.path.dirname(path)
#get src folder which contains classes
dire = os.path.join(parentdir,'sticks')

sys.path.append(dire)


unload_modules('Sticks')

import Sticks
from Sticks import Stick, stick_bridge
from compas.geometry import Line, Point, Vector
from compas_rhino.conversions import line_to_compas

assembly = []

for line in lines:
    compas_line = line_to_compas(line)
    stick = Stick(compas_line, width=width, depth=depth)
    assembly.append(stick)


# generates geometry of the stick0 class: Box
sticks = [s.geometry for s in assembly]
# ---------- end py3_6 ----------
py3_7 = Python3Script(lines=crv_2)  # -> out, my_points, planes, projected_crvs, centroids, my_vectors; inputs lines: list of Polyline; disabled
# ---------- py3_7: Python ----------
#locate stick class file in the same folder
from compas_rhino import unload_modules
import sys
import os
import math

import Rhino.Geometry as rg
from ghpythonlib.treehelpers import list_to_tree, tree_to_list


constrol_pts = []
for crv in lines:
    points = []
    for i in range(len(crv) - 1):
        points.append(crv[i])
    constrol_pts.append(points)

# rearange the points
planes = []
projected_crvs = []
centroids = []
vectors = []
for pts, pl in zip(constrol_pts, lines):
    if len(pts) > 2:
        vector_list = []
        plane = rg.Plane(pts[0], pts[1], pts[2])
        plane_normal = plane.Normal

        plc = rg.PolylineCurve(pl)
        crv = plc.ToNurbsCurve()
        projected_crv = crv.ProjectToPlane(crv, plane)

        # test: try to project along vector
        # pl = crv.ToPolyline(0.01, 0.01, 0, 0)
        # pl = rg.PolylineCurve(plc)
        # poly = rg.Polyline()
        # polyline = pl.TryGetPolyline()
        # print(polyline)
        # for pt in pl:
        #     print(pt)
        
        # rearenge pts in order
        mp = rg.AreaMassProperties.Compute(projected_crv, 0.1)
        if mp:
            centroid = mp.Centroid
            center_plane = rg.Plane(centroid, plane.XAxis, plane.YAxis)
            # angle between the vector
            for pt in pl:
                A = centroid
                B = pt
                v1 = rg.Vector3d(A)
                v2 = rg.Vector3d(B)
                vector = v1 - v2
                vector_list.append(vector)

        centroids.append(centroid)
        planes.append(center_plane)
        vectors.append(vector_list)
        projected_crvs.append(projected_crv)
    else:
        pass



my_points = list_to_tree(constrol_pts)
my_vectors = list_to_tree(vectors)
# ---------- end py3_7 ----------
number_slider_6 = Slider(2, range=0..100)  # disabled
number_slider_7 = Slider(2, range=0..100)  # disabled
number_slider_8 = Slider(5, range=0..10)  # disabled
number_slider_9 = Slider(5, range=0..10)  # disabled
number_slider_10 = Slider(5, range=0..10)  # disabled
draw = COMPASDraw(cg=py3_5.sticks)  # -> rg; disabled
#   port cg: The COMPAS geometry or datastructure to be drawn.
#   port rg: The Rhino geometry object.
# ---------- draw: Python ----------
# r: compas>=2.14.1
"""
Draws COMPAS geometry in Grasshopper.
"""

from typing import Any

import Grasshopper

from compas.scene import SceneObject


class CompasToRhinoGeometry(Grasshopper.Kernel.GH_ScriptInstance):
    def RunScript(self, cg):
        if not cg:
            return None

        return SceneObject(item=cg).draw()
# ---------- end draw ----------
draw_2 = COMPASDraw(cg=py3_6.sticks)  # -> rg; same code as draw
draw_3 = COMPASDraw(cg=py3_3.my_points)  # -> rg; disabled; same code as draw
crv_5 = Curve(py3_4.projected_crvs)
draw_4 = COMPASDraw(cg=py3_2.my_points)  # -> simplify(rg); same code as draw
draw_5 = COMPASDraw(cg=py3_2.sticks)  # -> simplify(rg); same code as draw
crv_6 = Curve(py3_7.projected_crvs)  # disabled
pln = Plane(py3_4.planes)
panel_3 = Panel("1")  # disabled
panel_4 = Panel("1")  # disabled
pln_2 = Plane(py3_7.planes)  # disabled
py3_8 = Python3Script(
    x_range=number_slider_9,
    y_range=number_slider_8,
    z_range=number_slider_10,
    offset_x=number_slider_6,
    offset_y=number_slider_7)  # -> out, sticks, my_points, polylines; inputs x_range: Int32, y_range: Int32, z_range: Int32, offset_x: Double, offset_y: Double; disabled
# ---------- py3_8: Python ----------
#locate stick class file in the same folder
from compas_rhino import unload_modules
import sys
import os
import math

#get current file path
path = ghenv.Component.OnPingDocument().FilePath
#get parent directory of the parent directory
parentdir = os.path.dirname(path)
#get src folder which contains classes
dire = os.path.join(parentdir,'sticks')

sys.path.append(dire)


unload_modules('Sticks')
unload_modules('OrtogonalModule')

import Sticks
from Sticks import Stick, stick_bridge
from OrtogonalModule import OStickModule
from compas.geometry import Line, Point, Vector, Polyline
from compas_rhino.conversions import line_to_compas
from ghpythonlib.treehelpers import list_to_tree, tree_to_list

stick_length = 2
stick_width = .13
stick_depth = .13

points = []
assembly = []

for z in range(z_range):
    row = []
    for x in range(x_range):
        grid_size_x = stick_length - 2*stick_depth + offset_x
        grid_size = stick_length - 2*stick_depth
        grid_size_z = stick_length - 2*stick_depth + offset_y
        pt = Point(x * grid_size_x, grid_size, z * grid_size_z)
        row.append(pt)
    points.append(row)




### make this like it is a class
### function of the class: to planarize all the points 
pol_pt = []
polylines = []

for i in range(z_range-1):
    i = i % z_range
    pol_points = []
    for j in range(x_range-1):
        j = j % x_range
        p0 = points[i][j]
        p1 = points[i][j+1]
        p3 = points[i+1][j]
        p2 = points[i+1][j+1]
        pol_points.append([p0, p1, p2, p3, p0])
    
    pol_pt.append(pol_points)

for p_list in pol_pt:
    for p in p_list:
        pol = Polyline(p)
        polylines.append(pol)


my_points = list_to_tree(points)


# sticks = [s.geometry for s in assembly]
# ---------- end py3_8 ----------
points = PointList(Points=py3_4.my_points, Size="1")
pt_3 = Point(py3_4.centroids)
tstat = TreeStatistics(Tree=draw_4)  # -> Paths, Length, Count
points_2 = PointList(Points=py3_7.my_points, Size=panel_3)  # disabled
pt_4 = Point(py3_7.centroids)  # disabled
preview = CustomPreview(
    Geometry=draw_2,
    Material={diffuse=RGB(221, 160, 221), emission=RGB(66, 48, 66), shine=0.5, specular=RGB(255, 255, 255), transparency=0})
deplane = DeconstructPlane(Plane=pln)  # -> Origin, XAxis, YAxis, ZAxis
points_3 = PointList(Points=draw_3, Size=panel_4)  # disabled
material = CreateMaterial(
    Diffuse=ColourSwatch(SwatchColor=RGB(0, 0, 0)),
    Specular=ColourSwatch(SwatchColor=RGB(31, 31, 31)),
    Emission=ColourSwatch(SwatchColor=RGB(181, 167, 129)),
    Transparency=0,
    Shine=0)
points_4 = PointList(Points=draw_4, Size="1")
deplane_2 = DeconstructPlane(Plane=pln_2)  # -> Origin, XAxis, YAxis, ZAxis; disabled
vdis = VectorDisplay(Anchor=pt_3, Vector=py3_4.my_vectors)
vdis_2 = VectorDisplay(Anchor=pt_4, Vector=py3_7.my_vectors)  # disabled
pline = PolyLine(Vertices=simplify(draw_3), Closed=invert(False))  # disabled
item = ListItem(List=tstat.Paths, Index=0, Wrap=True)
pline_2 = PolyLine(Vertices=simplify(draw_4), Closed=invert(False))
vdis_3 = VectorDisplay(Anchor=deplane.Origin, Vector=deplane.XAxis)
preview_2 = CustomPreview(Geometry=draw_5, Material=material)
vdis_4 = VectorDisplay(Anchor=deplane_2.Origin, Vector=deplane_2.XAxis)  # disabled
draw_6 = COMPASDraw(cg=py3_8.my_points)  # -> rg; disabled; same code as draw
draw_7 = COMPASDraw(cg=py3_8.polylines)  # -> rg; disabled; same code as draw
branch = TreeBranch(Tree=draw_4, Path=item, MaintainPaths=True)
panel_5 = Panel("1")  # disabled
draw_8 = COMPASDraw(cg=py3_8.sticks)  # -> rg; disabled; same code as draw
explode = Explode(Curve=pline_2, Recursive=True)  # -> Segments, Vertices
boundary = BoundarySurfaces(Edges=pline)  # disabled
boundary_2 = BoundarySurfaces(Edges=pline_2)
points_5 = PointList(Points=draw_6, Size=panel_5)  # disabled
preview_3 = CustomPreview(
    Geometry=boundary,
    Material={diffuse=RGB(221, 160, 221), emission=RGB(66, 48, 66), shine=0.5, specular=RGB(255, 255, 255), transparency=0})  # disabled
swatch = ColourSwatch(SwatchColor=RGB(0, 0, 0))  # disabled
swatch_2 = ColourSwatch(SwatchColor=RGB(255, 255, 255))  # disabled
preview_4 = CustomPreview(
    Geometry=boundary_2,
    Material={diffuse=RGB(221, 160, 221), emission=RGB(66, 48, 66), shine=0.5, specular=RGB(255, 255, 255), transparency=0})
len = Length(Curve=draw_4)
material_2 = CreateMaterial(Diffuse=swatch, Specular=swatch_2, Emission=swatch_2, Transparency=0, Shine=0)  # disabled
panel_6 = Panel(len)
preview_5 = CustomPreview(Geometry=draw_8, Material=material_2)  # disabled
