# Grasshopper definition Dec_05_Jerry_Sticks.gh (Grasshopper 1.0.8)
# plug-ins: Weaverbird

# ----
# Aggregation with Multiple Lengths and Angles
pt = Point(Point(-186.0594048, -107.2522057, 0))  # disabled
number_slider = Slider(29, range=0..180)  # disabled
xy = XYPlane(Origin=pt)  # disabled
yz = YZPlane(Origin=pt)  # disabled
xz = XZPlane(Origin=pt)  # disabled
rotate = Rotate(Geometry=xy, Angle=degrees(number_slider), Plane=xz)  # -> Geometry, Transform; disabled
number_slider_2 = Slider(0, range=0..180)  # disabled
pln = Plane(rotate.Geometry)  # disabled
number_slider_3 = Slider(0, range=0..10)  # disabled
number_slider_4 = Slider(0, range=0..10)  # disabled
number_slider_5 = Slider(0, range=0..1)  # disabled
cluster = Cluster(pln=pln, num=30)  # disabled
number_slider_6 = Slider(1, range=0..1)  # disabled
number_slider_7 = Slider(39, range=0..100)  # disabled
list = ValueList({"Regular": 0, "Random": 1}, selected="Random")  # disabled
panel = Panel("""200
500""")  # disabled
py3 = Python3Script(
    first_pln=pln,
    length_pattern=panel,
    seed=number_slider_7,
    agg_type=list,
    from_index=number_slider_3,
    from_t=number_slider_5,
    to_index=number_slider_4,
    to_t=number_slider_6,
    angle_pattern=number_slider_2)  # -> out, stick_out, axis_out, frame_out; inputs first_pln: Plane, length_pattern: list of Double, seed: Int32, agg_type: Int32, from_index: Int32, from_t: Double, to_index: Int32, to_t: Double, angle_pattern: list of Double; disabled
# ---------- py3: Python ----------
#locate stick class file in the same folder
from compas_rhino import unload_modules
import sys
import os
"""
#get current file path
path = ghenv.Component.OnPingDocument().FilePath
#get parent directory of the parent directory
parentdir = os.path.dirname(path)
#get src folder which contains classes
dire = os.path.join(parentdir,'scripts')

sys.path.append(dire)
"""

path = 'D:\\ETH\\Github\\MAS-2526\\08_SpatialAssemblies\\StudentProjects\\group_two\\J3RRY_Sticks_^o^\\scripts\\Package_v2'
sys.path.append(path)

unload_modules('J3RRY_SingleStick_v1')
unload_modules('J3RRY_Aggregation_v2')
unload_modules('J3RRY_Collision_v1')

from J3RRY_SingleStick_v1 import Stick
from J3RRY_Aggregation_v2 import Aggregation
from J3RRY_Collision_v1 import Collision

from compas.geometry import Line, Point, Vector
from compas.geometry import Transformation
from compas_rhino.conversions import plane_to_compas_frame, frame_to_rhino_plane

import random


"""Main Code"""
# Convert rhino plane to compas frame
first_pln = plane_to_compas_frame(first_pln)
# random pick length
agg = Aggregation(first_pln, length_pattern, angle_pattern, agg_type, seed)

agg.spawn_next_stick(from_index, from_t, to_index, to_t)
# Output
stick_out = agg.visualize()
axis_out = agg.axes

frame_out = [frame_to_rhino_plane(f) for f in agg.frames]
print (agg.sticks[0].corners)
# ---------- end py3 ----------
draw = COMPASDraw(cg=py3.stick_out)  # -> rg; disabled
#   port cg: The COMPAS geometry or datastructure to be drawn.
#   port rg: The Rhino geometry object.
# ---------- draw: Python ----------
# r: compas>=2.14.1
"""
Draws COMPAS geometry in Grasshopper.
"""

from typing import Any

import Grasshopper

from compas.scene import SceneObject


class CompasToRhinoGeometry(Grasshopper.Kernel.GH_ScriptInstance):
    def RunScript(self, cg):
        if not cg:
            return None

        return SceneObject(item=cg).draw()
# ---------- end draw ----------
pln_2 = Plane(py3.frame_out)  # disabled
draw_2 = COMPASDraw(cg=py3.axis_out)  # -> rg; disabled; same code as draw
number_slider_8 = Slider(9, range=0..10)  # disabled
cluster_2 = Cluster(pln=pln_2, num=30)  # disabled
lng = ListLength(List=draw)  # disabled
midpt = CurveMiddle(Curve=draw_2)  # disabled
series = Series(Start=0, Step=1, Count=lng)  # disabled
points = PointList(Points=midpt, Size=number_slider_8)  # disabled
gradient = Gradient(
    LowerLimit=0,
    UpperLimit=expr("x-1", lng),
    Parameter=series,
    stops=[0: RGB(80, 55, 25), 0.5: RGB(159, 65, 29), 1: RGB(174, 166, 129)])  # disabled
number_slider_9 = Slider(0.515, range=0..1)  # disabled
dmaterial = DeconstructMaterial(Material=gradient)  # -> Diffuse, Specular, Emission, Transparency, Shine; disabled
material = CreateMaterial(
    Diffuse=dmaterial.Diffuse,
    Specular=dmaterial.Specular,
    Emission=dmaterial.Emission,
    Transparency=number_slider_9,
    Shine=dmaterial.Shine)  # disabled
preview = CustomPreview(Geometry=draw, Material=material)  # disabled

# ----
# Aggregation with Multiple Lengths and Angles
pt_2 = Point(Point(-186.0594048, -107.2522057, 0))  # disabled
number_slider_10 = Slider(33, range=0..180)  # disabled
xy_2 = XYPlane(Origin=pt_2)  # disabled
yz_2 = YZPlane(Origin=pt_2)  # disabled
xz_2 = XZPlane(Origin=pt_2)  # disabled
rotate_2 = Rotate(Geometry=xy_2, Angle=degrees(number_slider_10), Plane=xz_2)  # -> Geometry, Transform; disabled
pln_3 = Plane(rotate_2.Geometry)  # disabled
number_slider_11 = Slider(1, range=0..100)  # disabled
cluster_3 = Cluster(pln=pln_3, num=30)  # disabled
number_slider_12 = Slider(30, range=0..100)  # disabled
list_2 = ValueList({"Regular": 0, "Random": 1}, selected="Regular")  # disabled
panel_2 = Panel("""0
30""")  # disabled
panel_3 = Panel("""200
500""")  # disabled
py3_2 = Python3Script(
    first_pln=pln_3,
    length_pattern=panel_3,
    seed=number_slider_12,
    agg_type=list_2,
    agg_count=number_slider_11,
    angle_pattern=panel_2)  # -> out, stick_out, axis_out, frame_out; inputs first_pln: Plane, length_pattern: list of Double, seed: Int32, agg_type: Int32, agg_count: Int32, angle_pattern: list of Double; disabled
# ---------- py3_2: Python ----------
#locate stick class file in the same folder
from compas_rhino import unload_modules
import sys
import os
"""
#get current file path
path = ghenv.Component.OnPingDocument().FilePath
#get parent directory of the parent directory
parentdir = os.path.dirname(path)
#get src folder which contains classes
dire = os.path.join(parentdir,'scripts')

sys.path.append(dire)
"""

path = 'D:\\ETH\\Github\\MAS-2526\\08_SpatialAssemblies\\StudentProjects\\group_two\\J3RRY_Sticks_^o^\\scripts\\Package_v2'
sys.path.append(path)

unload_modules('J3RRY_SingleStick_v1')
unload_modules('J3RRY_Aggregation_v2')
unload_modules('J3RRY_Collision_v1')

from J3RRY_SingleStick_v1 import Stick
from J3RRY_Aggregation_v2 import Aggregation
from J3RRY_Collision_v1 import Collision

from compas.geometry import Line, Point, Vector
from compas.geometry import Transformation
from compas_rhino.conversions import plane_to_compas_frame, frame_to_rhino_plane

import random


"""Main Code"""
# Convert rhino plane to compas frame
first_pln = plane_to_compas_frame(first_pln)
# random pick length
agg = Aggregation(first_pln, length_pattern, angle_pattern, agg_type, seed)

for i in range(agg_count):
    agg.spawn_next_stick_random(seed)
# Output
stick_out = agg.visualize()
axis_out = agg.axes

frame_out = [frame_to_rhino_plane(f) for f in agg.frames]
# ---------- end py3_2 ----------
draw_3 = COMPASDraw(cg=py3_2.stick_out)  # -> rg; disabled; same code as draw
pln_4 = Plane(py3_2.frame_out)  # disabled
draw_4 = COMPASDraw(cg=py3_2.axis_out)  # -> rg; disabled; same code as draw
number_slider_13 = Slider(9, range=0..10)  # disabled
cluster_4 = Cluster(pln=pln_4, num=30)  # disabled
lng_2 = ListLength(List=draw_3)  # disabled
midpt_2 = CurveMiddle(Curve=draw_4)  # disabled
series_2 = Series(Start=0, Step=1, Count=lng_2)  # disabled
points_2 = PointList(Points=midpt_2, Size=number_slider_13)  # disabled
gradient_2 = Gradient(
    LowerLimit=0,
    UpperLimit=expr("x-1", lng_2),
    Parameter=series_2,
    stops=[0: RGB(80, 55, 25), 0.5: RGB(159, 65, 29), 1: RGB(174, 166, 129)])  # disabled
number_slider_14 = Slider(0.515, range=0..1)  # disabled
dmaterial_2 = DeconstructMaterial(Material=gradient_2)  # -> Diffuse, Specular, Emission, Transparency, Shine; disabled
material_2 = CreateMaterial(
    Diffuse=dmaterial_2.Diffuse,
    Specular=dmaterial_2.Specular,
    Emission=dmaterial_2.Emission,
    Transparency=number_slider_14,
    Shine=dmaterial_2.Shine)  # disabled
preview_2 = CustomPreview(Geometry=draw_3, Material=material_2)  # disabled

# ----
# Aggregation with Multiple Lengths and Angles
pt_3 = Point(Point(-186.0594048, -107.2522057, 0))  # disabled
number_slider_15 = Slider(0, range=0..180)  # disabled
xy_3 = XYPlane(Origin=pt_3)  # disabled
yz_3 = YZPlane(Origin=pt_3)  # disabled
xz_3 = XZPlane(Origin=pt_3)  # disabled
rotate_3 = Rotate(Geometry=xy_3, Angle=degrees(number_slider_15), Plane=xz_3)  # -> Geometry, Transform; disabled
number_slider_16 = Slider(20, range=0..20)  # disabled
pln_5 = Plane(rotate_3.Geometry)  # disabled
number_slider_17 = Slider(100, range=0..100)  # disabled
number_slider_18 = Slider(20, range=0..20)  # disabled
cluster_5 = Cluster(pln=pln_5, num=30)  # disabled
number_slider_19 = Slider(47, range=0..100)  # disabled
list_3 = ValueList({"Regular": 0, "Random": 1}, selected="Random")  # disabled
panel_4 = Panel("""100
300
600""")  # disabled
panel_5 = Panel("""0
30
120""")  # disabled
py3_3 = Python3Script(
    first_pln=pln_5,
    length_pattern=panel_4,
    seed=number_slider_19,
    agg_type=list_3,
    agg_count=number_slider_17,
    max_attempts=number_slider_16,
    angle_pattern=panel_5)  # -> out, stick_out, axis_out, failed_sticks, failed_axes, collision_log; inputs first_pln: Plane, length_pattern: list of Double, seed: Int32, agg_type: Int32, agg_count: Int32, max_attempts: Int32, angle_pattern: list of Double; disabled
# ---------- py3_3: Python ----------
#locate stick class file in the same folder
from compas_rhino import unload_modules
import sys
import os
"""
#get current file path
path = ghenv.Component.OnPingDocument().FilePath
#get parent directory of the parent directory
parentdir = os.path.dirname(path)
#get src folder which contains classes
dire = os.path.join(parentdir,'scripts')

sys.path.append(dire)"""

path = 'D:\\ETH\\Github\\MAS-2526\\08_SpatialAssemblies\\StudentProjects\\group_two\\J3RRY_Sticks_^o^\\scripts\\Package_v2'
sys.path.append(path)

unload_modules('J3RRY_SingleStick_v1')
unload_modules('J3RRY_Aggregation_v2')
unload_modules('J3RRY_Collision_v1')

from J3RRY_SingleStick_v1 import Stick
from J3RRY_Aggregation_v2 import Aggregation
from J3RRY_Collision_v1 import Collision

from compas.geometry import Line, Point, Vector
from compas.geometry import Transformation
from compas_rhino.conversions import plane_to_compas_frame, frame_to_rhino_plane

import random


"""Main Code"""
# Convert rhino plane to compas frame
first_pln = plane_to_compas_frame(first_pln)
# random pick length
agg = Aggregation(first_pln, length_pattern, angle_pattern, agg_type, seed)


# Aggregation with Collision Check
index_overlap = []
for i in range(agg_count):
    new_stick = agg.spawn_next_stick_random_with_rejection(max_attempts, seed)

    if new_stick is None:
        # print (f"Spawn failed at iteration {i}.")
        break
    else:
        # print ("Success. No Collision.")
        pass


# Output
stick_out = agg.visualize()
axis_out = agg.axes

from Grasshopper import DataTree
from Grasshopper.Kernel.Data import GH_Path

failed_sticks = DataTree[object]()
failed_axes = DataTree[object]()
# print (agg.failed_sticks)
# print (len(agg.failed_sticks))

for i, branch in enumerate(agg.failed_sticks):
    sub_path = GH_Path(i + 1)
    for s in branch:
        failed_sticks.Add(s.geometry, sub_path)
        failed_axes.Add(s.axis, sub_path)


collision_log = DataTree[object]()
for i, log in enumerate(agg.collision_log):
    path = GH_Path(i + 1)

    # 1. primitive values first
    collision_log.Add(f"attempts = {log['attempts']}", path)
    collision_log.Add(f"fail_count = {log['fail_count']}", path)
    collision_log.Add(f"success = {log['success']}", path)
    collision_log.Add(f"reason = {log['reason']}", path)
    collision_log.Add(f"length = {log['params']['length']}", path)    
    collision_log.Add(f"angle = {log['params']['angle']}", path)
    collision_log.Add(f"from_index = {log['params']['from_index']}", path)
    collision_log.Add(f"to_index = {log['params']['to_index']}", path)
    collision_log.Add(f"from_t = {log['params']['from_t']}", path)
    collision_log.Add(f"to_t = {log['params']['to_t']}", path)
# ---------- end py3_3 ----------
draw_5 = COMPASDraw(cg=py3_3.failed_sticks)  # -> rg; disabled; same code as draw
draw_6 = COMPASDraw(cg=py3_3.failed_axes)  # -> rg; disabled; same code as draw
draw_7 = COMPASDraw(cg=py3_3.stick_out)  # -> rg; disabled; same code as draw
draw_8 = COMPASDraw(cg=py3_3.axis_out)  # -> rg; disabled; same code as draw
number_slider_20 = Slider(9, range=0..10)  # disabled
lng_3 = ListLength(List=draw_7)  # disabled
midpt_3 = CurveMiddle(Curve=draw_8)  # disabled
series_3 = Series(Start=0, Step=1, Count=lng_3)  # disabled
points_3 = PointList(Points=midpt_3, Size=number_slider_20)  # disabled
gradient_3 = Gradient(
    LowerLimit=0,
    UpperLimit=expr("x-1", lng_3),
    Parameter=series_3,
    stops=[0: RGB(80, 55, 25), 0.5: RGB(159, 65, 29), 1: RGB(174, 166, 129)])  # disabled
number_slider_21 = Slider(0.515, range=0..1)  # disabled
dmaterial_3 = DeconstructMaterial(Material=gradient_3)  # -> Diffuse, Specular, Emission, Transparency, Shine; disabled
material_3 = CreateMaterial(
    Diffuse=dmaterial_3.Diffuse,
    Specular=dmaterial_3.Specular,
    Emission=dmaterial_3.Emission,
    Transparency=number_slider_21,
    Shine=dmaterial_3.Shine)  # disabled
preview_3 = CustomPreview(Geometry=draw_7, Material=material_3)  # disabled

panel_6 = Panel(py3_3.collision_log)  # disabled
panel_7 = Panel(draw_5)  # disabled
panel_8 = Panel(py3_3.out)  # disabled

# ----
# Demo of Compas Point in Polyhedron
P = Plane(PlaneXY(0, 0, 0))  # disabled
wbicosahedron = WeaverbirdsMeshMeshIcosahedron(Plane=P, Radius=5)  # disabled
pop3d = Populate3D(Region={Plane=PlaneXY(0, 0, 0), X=Domain(0, 10), Y=Domain(0, 10), Z=Domain(0, 2)}, Count=100, Seed=1)  # disabled
pt_4 = Point(Point(4.472136021, 0, 2.23606801))  # disabled
py3_4 = Python3Script(x=wbicosahedron, y=pop3d, z=pt_4)  # -> out, a, b; inputs x: Mesh, y: list of Point3d, z: Point3d; disabled
# ---------- py3_4: Python ----------
import compas.geometry as cg
import compas_rhino.conversions as crc

mesh = crc.mesh_to_compas(x)
pts = [crc.point_to_compas(pt) for pt in y]

vertices, faces = mesh.to_vertices_and_faces()

print (mesh)
# print (vertices)
# print (faces)
poly = cg.Polyhedron(vertices, faces)
print (poly)

inside = []
for pt in pts:
    is_inside = cg.is_point_in_polyhedron(pt, poly)
    inside.append(is_inside)
a = inside

p = crc.point_to_compas(z)
is_inside = cg.is_point_in_polyhedron(p, poly)
b = is_inside
# ---------- end py3_4 ----------
panel_9 = Panel(py3_4.b)  # disabled
cull = CullPattern(List=pop3d, CullPattern=py3_4.a)  # disabled
panel_10 = Panel(py3_4.a)  # disabled

wbicosahedron_2 = WeaverbirdsMeshMeshIcosahedron(Plane=PlaneXY(0, 0, 0), Radius=Slider(295, range=0..1000))
mesh = Mesh(wbicosahedron_2)

# ----
# Aggregation within boundary
pt_5 = Point(Point(-186.0594048, -107.2522057, 0))
xy_4 = XYPlane(Origin=pt_5)
yz_4 = YZPlane(Origin=pt_5)
xz_4 = XZPlane(Origin=pt_5)
rotate_4 = Rotate(Geometry=xy_4, Angle=degrees(Slider(0, range=0..180)), Plane=xz_4)  # -> Geometry, Transform
pln_6 = Plane(rotate_4.Geometry)
number_slider_22 = Slider(10, range=0..20)
cluster_6 = Cluster(pln=pln_6, num=30)
list_4 = ValueList({"Regular": 0, "Random": 1}, selected="Random")
panel_11 = Panel("""0
45""")
panel_12 = Panel("""100
300
600""")
py3_5 = Python3Script(
    first_pln=pln_6,
    length_pattern=panel_12,
    seed=Slider(63, range=0..100),
    agg_type=list_4,
    agg_count=Slider(100, range=0..100),
    max_attempts=Slider(20, range=0..20),
    angle_pattern=panel_11,
    boundary_mesh=mesh)  # -> out, stick_out, axis_out, failed_sticks, failed_axes, collision_log, valid_sticks; inputs first_pln: Plane, length_pattern: list of Double, seed: Int32, agg_type: Int32, agg_count: Int32, max_attempts: Int32, angle_pattern: list of Double, boundary_mesh: Mesh
# ---------- py3_5: Python ----------
#locate stick class file in the same folder
from compas_rhino import unload_modules
import sys
import os
"""
#get current file path
path = ghenv.Component.OnPingDocument().FilePath
#get parent directory of the parent directory
parentdir = os.path.dirname(path)
#get src folder which contains classes
dire = os.path.join(parentdir,'scripts')

sys.path.append(dire)"""

path = 'D:\\ETH\\Github\\MAS-2526\\08_SpatialAssemblies\\StudentProjects\\group_two\\J3RRY_Sticks_^o^\\scripts\\Package_v2'
sys.path.append(path)

unload_modules('J3RRY_SingleStick_v1')
unload_modules('J3RRY_Aggregation_v2')
unload_modules('J3RRY_Collision_v1')

from J3RRY_SingleStick_v1 import Stick
from J3RRY_Aggregation_v2 import Aggregation
from J3RRY_Collision_v1 import Collision

from compas.geometry import Line, Point, Vector
from compas.geometry import Transformation
from compas_rhino.conversions import plane_to_compas_frame, frame_to_rhino_plane
import scriptcontext as sc
import random


"""Main Code"""

# Convert rhino plane to compas frame
first_pln = plane_to_compas_frame(first_pln)
# random pick length
agg = Aggregation(first_pln, length_pattern, angle_pattern, agg_type, seed)

# Aggregation with Collision Check
index_overlap = []
for i in range(agg_count):
    new_stick = agg.spawn_next_stick_random_in_boundary(
        boundary_mesh, max_attempts, seed)

    if new_stick is None:
        # print (f"Spawn failed at iteration {i}.")
        break
    else:
        # print ("Success. No Collision.")
        pass


# Output
stick_out = agg.visualize()
axis_out = agg.axes

from Grasshopper import DataTree
from Grasshopper.Kernel.Data import GH_Path

failed_sticks = DataTree[object]()
failed_axes = DataTree[object]()
valid_sticks = DataTree[object]()
valid_axes = DataTree[object]()

for i, branch in enumerate(agg.failed_sticks):
    sub_path = GH_Path(i + 1)
    for s in branch:
        failed_sticks.Add(s.geometry, sub_path)
        failed_axes.Add(s.axis, sub_path)

for i, branch in enumerate(agg.valid_sticks):
    sub_path = GH_Path(i + 1)
    for s in branch:
        valid_sticks.Add(s.geometry, sub_path)
        valid_axes.Add(s.axis, sub_path)



# collision_log = DataTree[object]()
# for i, log in enumerate(agg.collision_log):
#     path = GH_Path(i + 1)

#     # 1. primitive values first
#     collision_log.Add(f"attempts = {log['attempts']}", path)
#     collision_log.Add(f"fail_count = {log['fail_count']}", path)
#     collision_log.Add(f"success = {log['success']}", path)
#     collision_log.Add(f"reason = {log['reason']}", path)
#     collision_log.Add(f"length = {log['params']['length']}", path)    
#     collision_log.Add(f"angle = {log['params']['angle']}", path)
#     collision_log.Add(f"from_index = {log['params']['from_index']}", path)
#     collision_log.Add(f"to_index = {log['params']['to_index']}", path)
#     collision_log.Add(f"from_t = {log['params']['from_t']}", path)
#     collision_log.Add(f"to_t = {log['params']['to_t']}", path)
# ---------- end py3_5 ----------
draw_9 = COMPASDraw(cg=py3_5.failed_sticks)  # -> rg; same code as draw
draw_10 = COMPASDraw(cg=py3_5.failed_axes)  # -> rg; same code as draw
draw_11 = COMPASDraw(cg=py3_5.stick_out)  # -> rg; same code as draw
draw_12 = COMPASDraw(cg=py3_5.axis_out)  # -> rg; same code as draw
lng_4 = ListLength(List=draw_11)
midpt_4 = CurveMiddle(Curve=draw_12)
series_4 = Series(Start=0, Step=1, Count=lng_4)
points_4 = PointList(Points=midpt_4, Size=Slider(9, range=0..10))
gradient_4 = Gradient(
    LowerLimit=0,
    UpperLimit=expr("x-1", lng_4),
    Parameter=series_4,
    stops=[0: RGB(80, 55, 25), 0.5: RGB(159, 65, 29), 1: RGB(174, 166, 129)])
dmaterial_4 = DeconstructMaterial(Material=gradient_4)  # -> Diffuse, Specular, Emission, Transparency, Shine
material_4 = CreateMaterial(
    Diffuse=dmaterial_4.Diffuse,
    Specular=dmaterial_4.Specular,
    Emission=dmaterial_4.Emission,
    Transparency=Slider(0.515, range=0..1),
    Shine=dmaterial_4.Shine)
preview_4 = CustomPreview(Geometry=draw_11, Material=material_4)

wbedges = WeaverbirdsMeshEdges(MeshOrPolylines=mesh)
draw_13 = COMPASDraw(cg=py3_5.valid_sticks)  # -> rg; same code as draw
geo = Geometry(draw_13)
tstat = TreeStatistics(Tree=geo)  # -> Paths, Length, Count
geo_2 = Geometry(draw_11)
geo_3 = Geometry(draw_9)
viewer = ParamViewer(draw_13)
lng_5 = ListLength(List=geo_2)  # -> expr("x-1", Length)
tstat_2 = TreeStatistics(Tree=geo_3)  # -> Paths, Length, Count
min = Minimum(A=Slider(0, range=0..100), B=lng_5)
item = ListItem(List=tstat.Paths, Index=min, Wrap=True)
branch = TreeBranch(Tree=geo, Path=item, MaintainPaths=True)
item_2 = ListItem(List=tstat_2.Paths, Index=min, Wrap=True)
series_5 = Series(Start=0, Step=1, Count=min)
panel_13 = Panel(py3_5.collision_log)
branch_2 = TreeBranch(Tree=geo_3, Path=item_2, MaintainPaths=True)
item_3 = ListItem(List=geo_2, Index=series_5, Wrap=True)
lng_6 = ListLength(List=item_3)
series_6 = Series(Start=0, Step=1, Count=lng_6)
panel_14 = Panel(py3_5.out)
gradient_5 = Gradient(
    LowerLimit=0,
    UpperLimit=expr("x-1", lng_6),
    Parameter=series_6,
    stops=[0: RGB(80, 55, 25), 0.5: RGB(159, 65, 29), 1: RGB(174, 166, 129)])
dmaterial_5 = DeconstructMaterial(Material=gradient_5)  # -> Diffuse, Specular, Emission, Transparency, Shine
material_5 = CreateMaterial(
    Diffuse=dmaterial_5.Diffuse,
    Specular=dmaterial_5.Specular,
    Emission=dmaterial_5.Emission,
    Transparency=Slider(0.515, range=0..1),
    Shine=dmaterial_5.Shine)
preview_5 = CustomPreview(Geometry=item_3, Material=material_5)

# ==== cluster Cluster
pln = ClusterInput()
num = ClusterInput()
pln_2 = Plane(graft(pln))
num_2 = Number(num)
deplane = DeconstructPlane(Plane=pln_2)  # -> flatten(Origin), XAxis, YAxis, ZAxis
entwine = Entwine(Branch00=deplane.XAxis, Branch01=deplane.YAxis, Branch02=deplane.ZAxis, FlattenInputs=True)
merge = Merge(
    Data1=ColourSwatch(SwatchColor=RGB(255, 0, 0)),
    Data2=ColourSwatch(SwatchColor=RGB(0, 255, 0)),
    Data3=ColourSwatch(SwatchColor=RGB(0, 0, 255)))  # -> graft(Result)
multiplication = Multiplication(A=entwine, B=num_2)
vdisex = VectorDisplayEx(Point=deplane.Origin, Vector=multiplication, Colour=merge, Width=2)
