# Grasshopper definition Root_Frames_&_Bridges.gh (Grasshopper 1.0.8)
# plug-ins: Telepathy

number_slider = Slider(200, range=0..1000)  # disabled
number_slider_2 = Slider(0, range=0..3)  # disabled
number_slider_3 = Slider(25, range=0..50)  # disabled
number_slider_4 = Slider(52, range=0..180)  # disabled

# ---- group: create_plane
number_slider_5 = Slider(0, range=0..1000)  # disabled
number_slider_6 = Slider(0, range=0..1000)  # disabled
number_slider_7 = Slider(0, range=0..1000)  # disabled
number_slider_8 = Slider(35, range=0..360)  # disabled
pt = ConstructPoint(XCoordinate=number_slider_5, YCoordinate=number_slider_7, ZCoordinate=number_slider_6)  # disabled
xy = XYPlane(Origin=pt)  # disabled
rot3d = Rotate3D(Geometry=xy, Angle=degrees(number_slider_8), Center=pt, Axis=Vector(0, 0, 1))  # -> Geometry, Transform; disabled

# ----
number_slider_9 = Slider(50, range=0..1000)  # disabled
number_slider_10 = Slider(50, range=0..1000)  # disabled
number_slider_11 = Slider(200, range=0..1000)  # disabled
py_grow = Python3Script(
    root_plane=rot3d.Geometry,
    stick_length=number_slider,
    face_index=number_slider_2,
    offset=number_slider_3,
    angle=number_slider_4)  # -> out, geometries, frames; inputs face_index: Int32, offset: Double, angle: Double; disabled
# ---------- py_grow: Python ----------
# r: compas>=2.14.1
# venv: sticks

import sys
import os
import math

#get current file path
path = ghenv.Component.OnPingDocument().FilePath
# print (path)
#get parent directory of the parent directory
parentdir = os.path.dirname(path)
# print (parentdir)
#get src folder which contains classes
dire = os.path.join(parentdir,'scripts')
print (dire)

sys.path.append(dire)

from compas_rhino import unload_modules

unload_modules("Sticks")
unload_modules("stick_module")

import Sticks
from Sticks import Stick 
from stick_module import BranchingModule
from compas.geometry import Line, Point, Vector, Frame

stick_width = 13.0
stick_depth = 13.0

from compas_rhino.conversions import plane_to_compas_frame, frame_to_rhino_plane

# Convert input to compas
root = plane_to_compas_frame(root_plane)

# Initialize tree
tree = BranchingModule(root, stick_length=stick_length, width = stick_width, depth = stick_depth)

# Grow tree
tree.grow_stick(face_index = face_index, angle = angle, offset = offset)

# Visualize
geometries = tree.visualize()
frames = [stick.frame for stick in tree.sticks]
# ---------- end py_grow ----------

# ---- group: _REF_LIBRARY
number_slider_12 = Slider(9, range=0..90)  # disabled
choose_axis = Panel("X")  # disabled
number_slider_13 = Slider(12, range=-20..600)  # disabled
number_slider_14 = Slider(10, range=0..10)  # disabled
number_slider_15 = Slider(3, range=0..10)  # disabled
number_slider_16 = Slider(1, range=0..30)  # disabled
xy_2 = XYPlane(Origin=Point(0, 0, 0))  # disabled
crv = Curve(<curve referenced from the Rhino model>)  # disabled
py3 = Python3Script(
    curve=crv,
    num_sides=number_slider_15,
    radius=number_slider_14,
    total_height=number_slider_13,
    h_subdivisions=number_slider_16)  # -> out, column_mesh, list_points, center_points, column_mesh_rhino; inputs curve: Polyline, num_sides: Int32, radius: Int32, total_height: Int32, h_subdivisions: Int32; disabled
# ---------- py3: Python ----------
import mola
from mola import module_rhino
import math
import Rhino.Geometry as rg

def points_on_crv(curve):
    list_of_points = []
    for p in curve:
        pt = rg.Point3d(p)
        list_of_points.append(pt)
    return list_of_points

def points_on_polygon(num_sides, radius):   
    list_of_points = []
    theta = (2*math.pi)/num_sides
    for i in range(num_sides):
        angle = i * theta
        x = radius * math.cos(angle)
        y = radius * math.sin(angle)
        z = 0
        pt = rg.Point3d(x,y,z)
        list_of_points.append(pt)
    return list_of_points


if curve is not None:
    list_points = points_on_crv(curve)

else:
    list_points = points_on_polygon(num_sides, radius)



column_mesh = mola.Mesh()

new_pts = []

for layer_no in range (h_subdivisions +1):
    y = total_height/h_subdivisions * layer_no + float(114.5)
    for p in list_points:
        pt = rg.Point3d(p)
        pt[1] = y
        new_pts.append (pt)
        column_mesh.add_vertex(pt[0],pt[1], pt[2])

points_per_layer = len(list_points)

for layer_no in range (h_subdivisions):
    current_layer = layer_no * points_per_layer
    next_layer = (layer_no + 1) * points_per_layer
    for i in range (points_per_layer-1):
        next_i = (i+1) % points_per_layer

        v0 = column_mesh.vertices[current_layer + i]
        v1 = column_mesh.vertices[current_layer + next_i]
        v2 = column_mesh.vertices[next_layer + next_i]
        v3 = column_mesh.vertices[next_layer + i]

        column_mesh.add_face([v0,v1,v2,v3])

center_points = []
for f in (column_mesh.faces):
    c = f.center()
    
    pts = rg.Point3d(c.x, c.y, c.z)
    center_points.append(pts)

column_mesh.update_topology()
column_mesh_rhino = module_rhino.display_mesh(column_mesh)
# ---------- end py3 ----------
geo = Geometry(py3.column_mesh_rhino)  # disabled
geo_2 = Geometry(py3.list_points)  # disabled

# ----
number_slider_17 = Slider(100, range=0..1000)  # disabled
rh_geometry = Geometry([<surface referenced from the Rhino model> x8])  # disabled

number_slider_18 = Slider(30, range=0..135)  # disabled
number_slider_19 = Slider(1, range=0..20)  # disabled
number_slider_20 = Slider(0.8, range=0..1)  # disabled

detect_collisions = BooleanToggle(True)  # disabled
debug_mode = BooleanToggle(False)  # disabled
do_bridging = BooleanToggle(True)  # disabled
lite_mode = BooleanToggle(False)  # disabled

angle_rule = ValueList({"-30", "0", "30", "60"}, selected="-30")  # disabled
face_rule = ValueList({"0", "1", "2", "3"}, selected="1")  # disabled

number_slider_21 = Slider(48, range=0..360)  # disabled
pt_2 = ConstructPoint(XCoordinate=number_slider_10, YCoordinate=number_slider_9, ZCoordinate=number_slider_11)  # disabled
number_slider_22 = Slider(100, range=0..250)
xy_3 = XYPlane(Origin=pt_2)  # disabled
bridged_branched_sticks_lite = Python3Script(
    surface_or_curve=rh_geometry,
    point_density=number_slider_17,
    angle_rule=angle_rule,
    face_rule=face_rule,
    stick_angle=number_slider_18,
    offset01=number_slider_20,
    steps=number_slider_19,
    do_bridging=do_bridging,
    detect_collisions=detect_collisions,
    debug_mode=debug_mode,
    lite_mode=lite_mode)  # -> out, geometries, colors, frames, sticks, dbg_root_frames, dbg_root_axes, dbg_branch_geos, dbg_bridge_geos; inputs surface_or_curve: Surface, point_density: Int32, angle_rule: String, face_rule: String, steps: Int32, do_bridging: Int32, detect_collisions: Double; disabled
# ---------- bridged_branched_sticks_lite: Python ----------
"""
Bridged_Branched_Sticks_LITE

Inputs:
    surface_or_curve : Brep / Surface / Curve
    point_density    : int
    angle_rule       : string (e.g. "15, -10, 5")
    face_rule        : string (e.g. "2,3,4,5")
    stick_angle      : float (deg)
    offset01         : float (0–1 blend)
    steps            : int
    do_bridging      : bool
    detect_collisions: bool
    debug_mode       : bool (extra logging only)
    lite_mode        : bool (unused hook)

Outputs:
    out              : log string
    geometries       : Breps of all sticks
    colors           : System.Drawing.Color list for each Brep
    frames           : list of COMPAS Frames (one per stick)
    sticks           : Stick objects (for advanced use)
    dbg_root_frames  : root edge frames
    dbg_root_axes    : root axes as lines
    dbg_branch_geos  : branch axes as lines
    dbg_bridge_geos  : bridge axes as lines
"""

import os
import sys
import importlib
import traceback
import Rhino.Geometry as rg
import System.Drawing as SD

# ----------------------------------------------------------------------
# Helper: COMPAS Stick → Rhino Brep box
# ----------------------------------------------------------------------

def stick_to_rhino_box(stick):
    f = stick.frame
    origin = rg.Point3d(f.point.x, f.point.y, f.point.z)
    x = rg.Vector3d(f.xaxis.x, f.xaxis.y, f.xaxis.z)
    y = rg.Vector3d(f.yaxis.x, f.yaxis.y, f.yaxis.z)
    plane = rg.Plane(origin, x, y)

    L = stick.length
    W = stick.width
    D = stick.depth

    ix = rg.Interval(-0.5 * L, 0.5 * L)
    iy = rg.Interval(-0.5 * W, 0.5 * W)
    iz = rg.Interval(-0.5 * D, 0.5 * D)

    box = rg.Box(plane, ix, iy, iz)
    return box.ToBrep()

def compas_line_to_rhino(line):
    p0 = rg.Point3d(line.start.x, line.start.y, line.start.z)
    p1 = rg.Point3d(line.end.x, line.end.y, line.end.z)
    return rg.LineCurve(p0, p1)

def color_for_stick(s):
    # collision overrides everything
    if getattr(s, "collided", False):
        return SD.Color.FromArgb(255, 255, 0, 0)          # Red

    if getattr(s, "is_root", False):
        return SD.Color.FromArgb(255, 255, 255, 0)        # Yellow

    fam = getattr(s, "family", None)
    if fam == "Y":
        return SD.Color.FromArgb(255, 255, 182, 193)      # Light pink
    if fam == "Z":
        return SD.Color.FromArgb(255, 144, 238, 144)      # Light green
    if fam == "BRIDGE":
        return SD.Color.FromArgb(255, 245, 245, 220)      # Beige

    return SD.Color.FromArgb(255, 255, 255, 0)            # default: yellow


# ----------------------------------------------------------------------
# 0. Resolve /scripts folder & import modules
# ----------------------------------------------------------------------

log_lines = []
def log(msg):
    log_lines.append(str(msg))
    print(msg)

# ensure GH file is saved
gh_path = ghenv.Component.OnPingDocument().FilePath
if not gh_path:
    raise RuntimeError("Save the GH file before running this component.")

root_dir = os.path.dirname(gh_path)
script_dir = os.path.join(root_dir, "scripts")

log("========================================")
log("USING SCRIPT DIR: {}".format(script_dir))
if script_dir not in sys.path:
    sys.path.insert(0, script_dir)
log("sys.path[0]: {}".format(sys.path[0]))

if not os.path.exists(script_dir):
    raise RuntimeError("Missing /scripts folder next to GH file.")

log("Directory Listing: {}".format(os.listdir(script_dir)))
log("========================================")

MODULES = ["stick_fixed", "branch", "bridge", "rf_core"]

# unload previous versions (hot-reload in GH)
for m in MODULES:
    if m in sys.modules:
        log("Removing previously loaded module: {}".format(m))
        del sys.modules[m]

try:
    import stick_fixed
    import branch
    import bridge
    import rf_core
    importlib.reload(stick_fixed)
    importlib.reload(branch)
    importlib.reload(bridge)
    importlib.reload(rf_core)
    from rf_core import RootFrames
    log("SUCCESS — Imported all modules.")
except Exception:
    log("\n==== IMPORT ERROR ====")
    traceback.print_exc()
    raise

# ----------------------------------------------------------------------
# 1. Prepare input geometry (Surface / Brep / Curve)
# ----------------------------------------------------------------------

# unwrap lists if needed
geom_in = surface_or_curve
if isinstance(geom_in, (list, tuple)):
    geom_in = geom_in[0] if geom_in else None

surf_input = None
curve_input = None

if isinstance(geom_in, rg.Brep):
    if geom_in.Faces.Count > 0:
        surf_input = geom_in.Faces[0]
elif isinstance(geom_in, rg.BrepFace):
    surf_input = geom_in
elif isinstance(geom_in, rg.Surface):
    surf_input = geom_in
elif isinstance(geom_in, rg.Curve):
    curve_input = geom_in
else:
    if geom_in is not None:
        log("WARNING: Unsupported geometry type: {}".format(type(geom_in)))

# ----------------------------------------------------------------------
# 2. Run RootFrames pipeline
# ----------------------------------------------------------------------

from rf_core import RootFrames

sticks_out = []
frames_out = []
dbg_root_frames = []
dbg_root_axes = []
dbg_branch_geos = []
dbg_bridge_geos = []
geometries = []
colors = []
out = ""

try:
    RF = RootFrames(
        surface=surf_input,
        curve=curve_input,
        point_density=point_density,
        stick_length=None,
        stick_width=None,
        stick_depth=None
    )

    all_sticks = RF.run(
        steps=int(steps),
        stick_angle=float(stick_angle),
        offset01=float(offset01),
        detect_collisions=bool(detect_collisions),
        do_bridging=bool(do_bridging),
        face_rule=str(face_rule) if face_rule else None,
        angle_rule=str(angle_rule) if angle_rule else None,
        debug=bool(debug_mode),
        collision_clearance=0.0,
    )

    sticks_out = all_sticks
    frames_out = [s.frame for s in all_sticks]

    dbg_root_frames = RF.root_frames_debug
    dbg_root_axes = [compas_line_to_rhino(a) for a in RF.root_axes_debug]
    dbg_branch_geos = [compas_line_to_rhino(a) for a in RF.branch_axes_debug]
    dbg_bridge_geos = [compas_line_to_rhino(a) for a in RF.bridge_axes_debug]

    # build Breps + colors
    for s in sticks_out:
        try:
            brep = stick_to_rhino_box(s)
            geometries.append(brep)
            colors.append(color_for_stick(s))
        except Exception:
            geometries.append(None)
            colors.append(SD.Color.FromArgb(255, 0, 0, 0))

except Exception:
    log("\n==== PIPELINE ERROR ====")
    traceback.print_exc()
    raise RuntimeError("RootFrames execution failed. See traceback above.")

out = "\n".join(log_lines)
# ---------- end bridged_branched_sticks_lite ----------
rot3d_2 = Rotate3D(Geometry=xy_3, Angle=degrees(number_slider_21), Center=pt_2, Axis=Vector(0, 0, 1))  # -> Geometry, Transform; disabled
geo_3 = Geometry([<surface referenced from the Rhino model> x9])
number_slider_23 = Slider(7, range=0..10)  # disabled
number_slider_24 = Slider(0, range=0..50)  # disabled
number_slider_25 = Slider(100, range=0..100)  # disabled
info = COMPASInfo()  # -> info
#   port info: Environment info.
# ---------- info: Python ----------
# r: compas>=2.14.1
"""
Displays information about the active COMPAS environment.
"""

import os

import Grasshopper

import compas


class CompasInfo(Grasshopper.Kernel.GH_ScriptInstance):
    def RunScript(self):
        try:
            import compas_bootstrapper

            environment_name = compas_bootstrapper.ENVIRONMENT_NAME
        except ImportError:
            environment_name = os.path.dirname(compas.__file__)
            environment_name = os.path.abspath(os.path.join(environment_name, ".."))

        ghenv.Component.Message = "COMPAS v{}".format(compas.__version__)  # noqa: F821
        info = "COMPAS Version: {}\nEnvironment: {}"
        return info.format(compas.__version__, environment_name)
# ---------- end info ----------
gen_rhplanes = Python3Script(
    surface=geo_3,
    point_density=Slider(200, range=0..500),
    point_randomness=Slider(1, range=0..1),
    min_stick_length=number_slider_22)  # -> out, list_pts, rootplanes; inputs surface: Surface, point_density: Int32, point_randomness: Double, min_stick_length: Int32
# ---------- gen_rhplanes: Python ----------
import Rhino.Geometry as rg
import random

# INPUTS: surface, point_density, point_randomness, min_stick_length

def get_domain_offset_surface(srf, offset_dist):
    u_domain = srf.Domain(0)
    v_domain = srf.Domain(1)

    u_len = u_domain.Length
    v_len = v_domain.Length
    max_len = max(u_len, v_len)
    buffer = offset_dist / max_len

    sample_count = 20
    trim_pts = []

    for i in range(sample_count + 1):
        for j in range(sample_count + 1):
            u = u_domain.T0 + (u_len * i / sample_count)
            v = v_domain.T0 + (v_len * j / sample_count)
            u_norm = (u - u_domain.T0) / u_len
            v_norm = (v - v_domain.T0) / v_len

            if buffer < u_norm < 1 - buffer and buffer < v_norm < 1 - buffer:
                trim_pts.append((u, v))
    return trim_pts


def generate_points(srf, uv_pts, density, randomness, min_spacing, max_spacing):
    list_pts = []
    rootplanes = []
    
    # Sort by increasing V to create a vertical gradient
    uv_pts.sort(key=lambda x: x[1])

    for uv in uv_pts:
        u, v = uv

        # Probability gradient based on V
        v_ratio = (v - srf.Domain(1).T0) / srf.Domain(1).Length
        prob = v_ratio ** 2  # Exponential increase in probability
        if random.random() > prob:
            continue
        
        pt = srf.PointAt(u, v)
        
        # Check distances to existing points
        if all(pt.DistanceTo(p) > random.uniform(min_spacing, max_spacing) for p in list_pts):
            list_pts.append(pt)
            normal = srf.NormalAt(u, v)
            plane = rg.Plane(pt, normal)
            rootplanes.append(plane)

        if len(list_pts) >= density:
            break
    return list_pts, rootplanes

# === Parameters ===
edge_offset = 0.8 * min_stick_length
min_spacing = 0.6 * min_stick_length
max_spacing = 1.2 * min_stick_length

# Step 1: Get UV coordinates in trimmed zone
uv_coords = get_domain_offset_surface(surface, edge_offset)

# Step 2: Generate spaced points with gradient
points, planes = generate_points(surface, uv_coords, point_density, point_randomness, min_spacing, max_spacing)

#geometry

list_pts= points
rootplanes = planes
# ---------- end gen_rhplanes ----------
rhplanes_to_frames = Python3Script(
    rootplanes=flatten(gen_rhplanes.rootplanes),
    stick_length=number_slider_22,
    desired_number_of_base_roots=Slider(100, range=0..100))  # -> out, points_list, paired_root_frames, direction_vectors, direction_lines, layered_frames; inputs rootplanes: list of Plane, stick_length: Int32, desired_number_of_base_roots: Int32
# ---------- rhplanes_to_frames: Python ----------
from compas.geometry import Frame, Point, Vector, Line, distance_point_point

# Step 1: Convert GH planes to COMPAS Frames
root_frames = []
for i, pl in enumerate(rootplanes):
    try:
        origin = pl.Origin
        xaxis = pl.XAxis
        yaxis = pl.YAxis
        frame = Frame(
            Point(origin.X, origin.Y, origin.Z),
            Vector(xaxis.X, xaxis.Y, xaxis.Z),
            Vector(yaxis.X, yaxis.Y, yaxis.Z)
        )
        root_frames.append(frame)
    except Exception as e:
        print(f"❌ Failed to convert plane {i}: {e}")

# Step 2: Parameters
max_distance = 4 * stick_length
total_height = 500
layer_fraction = 0.25
layer_height = total_height * layer_fraction

# Step 3: Group root frames into layers by Z height
sorted_frames = sorted(root_frames, key=lambda f: f.point.z)

layers = []
current_layer = []
z_min = sorted_frames[0].point.z if sorted_frames else 0

for f in sorted_frames:
    if f.point.z - z_min < layer_height:
        current_layer.append(f)
    else:
        layers.append(current_layer)
        current_layer = [f]
        z_min = f.point.z

if current_layer:
    layers.append(current_layer)

print(f"✅ Total layers found: {len(layers)}")

# Output layered frames for bridging
layered_frames = layers

# Step 4: Pairing logic (for branching)
paired_root_frames = []
direction_vectors = []
direction_lines = []

for layer_index, layer_frames in enumerate(layers):
    if len(layer_frames) < 2:
        continue

    # Split layer into Group_Y and Group_Z
    if layer_index % 2 == 0:
        Group_Y = [f for i, f in enumerate(layer_frames) if i % 2 == 0]
        Group_Z = [f for i, f in enumerate(layer_frames) if i % 2 == 1]
    else:
        Group_Y = [f for i, f in enumerate(layer_frames) if i % 2 == 1]
        Group_Z = [f for i, f in enumerate(layer_frames) if i % 2 == 0]

    for a in Group_Y:
        closest_b = None
        min_dist = float('inf')

        for b in Group_Z:
            dist = distance_point_point(a.point, b.point)
            if dist < min_dist and dist <= max_distance:
                closest_b = b
                min_dist = dist

        if closest_b:
            direction = (closest_b.point - a.point)
            if direction.length > 0:
                direction = direction.unitized()

                # Rebuild aligned frame
                xaxis = Vector(1, 0, 0)
                if abs(direction.dot(xaxis)) > 0.99:
                    xaxis = Vector(0, 1, 0)
                yaxis = direction.cross(xaxis).unitized()
                xaxis = yaxis.cross(direction).unitized()

                frame = Frame(a.point, xaxis, yaxis)

                paired_root_frames.append(frame)
                direction_vectors.append(direction)
                direction_lines.append(Line(a.point, a.point + direction * stick_length))

                Group_Z.remove(closest_b)  # Prevent reuse

print(f"✅ Final paired frames: {len(paired_root_frames)}")
print(f"✅ Layered frames for bridging: {sum([len(l) for l in layered_frames])} frames")

# Output for GH
points_list = [f.point for f in root_frames]
OUT = points_list, paired_root_frames, direction_vectors, direction_lines, layered_frames
print(type(layered_frames))
# ---------- end rhplanes_to_frames ----------
geo_4 = Geometry(bridged_branched_sticks_lite.geometries)  # disabled
panel = Panel(info)
py3_2 = Python3Script()  # -> out, a; inputs gh_planes: Plane; unedited script template

panel_2 = Panel(bridged_branched_sticks_lite.dbg_bridge_geos)  # disabled
panel_3 = Panel(bridged_branched_sticks_lite.dbg_branch_geos)  # disabled

panel_4 = Panel(bridged_branched_sticks_lite.out)  # disabled
compas_draw = COMPASDraw(cg=bridged_branched_sticks_lite.frames)  # -> rg; disabled
#   port cg: The COMPAS geometry or datastructure to be drawn.
#   port rg: The Rhino geometry object.
# ---------- compas_draw: Python ----------
# r: compas>=2.14.1
"""
Draws COMPAS geometry in Grasshopper.
"""

from typing import Any

import Grasshopper

from compas.scene import SceneObject


class CompasToRhinoGeometry(Grasshopper.Kernel.GH_ScriptInstance):
    def RunScript(self, cg):
        if not cg:
            return None

        return SceneObject(item=cg).draw()
# ---------- end compas_draw ----------
py3_3 = Python3Script(
    root_frame=py_grow.frames,
    target_plane=rot3d_2.Geometry,
    offset_root_child=number_slider_23,
    offset_target_child=number_slider_24,
    stick_length=number_slider_25)  # -> out, geometries, frames; inputs target_plane: Plane, offset_root_child: Double, offset_target_child: Double, stick_length: Double; disabled
# ---------- py3_3: Python ----------
# r: compas>=2.14.1
# venv: sticks

import sys, os, math

path = ghenv.Component.OnPingDocument().FilePath
parentdir = os.path.dirname(path)
scripts = os.path.join(parentdir, 'scripts')
sys.path.append(scripts)

from compas_rhino import unload_modules
unload_modules("Sticks")
unload_modules("stick_bridge_v2")

from stick_bridge_v2 import GrowTowards
from RootFrames import Stick


from compas_rhino.conversions import plane_to_compas_frame
from compas.geometry import Frame

stick_width = 13.0
stick_depth = 13.0

# GH inputs:
#   root_frame  : COMPAS Frame (from previous module)
#   target_plane: Rhino Plane  (your target)
#   offset_root_child, offset_target_child : floats
#   stick_length: float



target_frame = plane_to_compas_frame(target_plane)

bridge = GrowTowards(
    root_frame=root_frame,
    target_frame=target_frame,
    offset_root_child=offset_root_child,
    offset_target_child=offset_target_child,
    stick_length=stick_length,
    width=stick_width,
    depth=stick_depth
)

geometries = bridge.visualize()
frames = [stick.frame for stick in bridge.sticks]

print("root_frame:", type(root_frame), root_frame)
print("target_frame:", type(target_frame), target_frame)
# ---------- end py3_3 ----------
panel_5 = Panel(rhplanes_to_frames.layered_frames)
draw = COMPASDraw(cg=rhplanes_to_frames.direction_vectors)  # -> rg; same code as compas_draw
panel_6 = Panel(gen_rhplanes.rootplanes)
compas_draw_2 = COMPASDraw(cg=py3_3.geometries)  # -> rg; disabled; same code as compas_draw
branching = Python3Script(
    paired_root_frames=rhplanes_to_frames.paired_root_frames,
    direction_lines=rhplanes_to_frames.direction_lines,
    direction_vectors=rhplanes_to_frames.direction_vectors,
    face_index=Slider(1, range=0..5),
    stick_angle=Slider(70, range=0..90),
    offset=Slider(33, range=0..90),
    root_index=Slider(0, range=0..5),
    use_root_index=Toggle(True))  # -> out, parent_frames, geometries; inputs paired_root_frames: list, direction_lines: list, direction_vectors: list, face_index: Int32, stick_angle: Int32, offset: Int32, root_index: Int32, use_root_index: Boolean
# ---------- branching: Python ----------
import sys
import os
import math

from compas.geometry import Line, Point, Vector, Frame, Rotation
from compas_rhino import unload_modules

# Auto-load external scripts
path = ghenv.Component.OnPingDocument().FilePath
parentdir = os.path.dirname(path)
dire = os.path.join(parentdir, 'scripts')
sys.path.append(dire)

unload_modules("Sticks")
unload_modules("stick_module")

import Sticks
from Sticks import Stick 
from branch import BranchingModule

print(">>> Number of root frames:", len(paired_root_frames))
print(">>> Number of growth directions:", len(direction_vectors))


# Constants
stick_length = 200
stick_width = 13.0
stick_depth = 13.0

# === Step 1: Filter only valid frame–direction pairs ===
if paired_root_frames is None or direction_vectors is None:
    paired_root_frames = []
    growth_directions = []

valid_inputs = []
for i in range(min(len(paired_root_frames), len(direction_vectors))):
    frame = paired_root_frames[i]
    direction = direction_vectors[i]
    if frame is not None and direction is not None:
        valid_inputs.append((frame, direction))

# Storage
all_geometries = []
all_frames = []

# === Step 2: Branching from aligned roots ===
for i, (original_root, growth_vector) in enumerate(valid_inputs):
    base_point = original_root.point
    zaxis = growth_vector.unitized()

    # Avoid degenerate cross products
    temp_x = Vector(1, 0, 0)
    if abs(zaxis.dot(temp_x)) > 0.99:
        temp_x = Vector(0, 1, 0)

    yaxis = zaxis.cross(temp_x).unitized()
    xaxis = yaxis.cross(zaxis).unitized()

    # Rebuild aligned frame
    aligned_root = Frame(base_point - zaxis * (stick_depth / 2), xaxis, yaxis)

    # Build tree + grow from 2 faces
    tree = BranchingModule(aligned_root, stick_length=stick_length, width=stick_width, depth=stick_depth)
    tree.grow_stick(face_index=face_index, angle=stick_angle, offset=offset)
    tree.grow_stick(face_index=2, angle=stick_angle, offset=offset)

    all_geometries.extend(tree.visualize())
    all_frames.extend([stick.frame for stick in tree.sticks])

# Output
geometries = all_geometries
frames = all_frames
# ---------- end branching ----------
list = ValueList({"edge", "center"}, selected="center")
bridging = Python3Script(
    layered_frames=rhplanes_to_frames.layered_frames,
    mode=list,
    max_distance=Slider(73, range=0..100),
    density_variation=Slider(500, range=0..500),
    angle=Slider(60, range=0..100))  # -> out, geometries; inputs layered_frames: list of Plane, mode: String, angle: String
# ---------- bridging: Python ----------
import sys
import os
import math
from compas.geometry import Frame, Point, Vector, distance_point_point, centroid_points
from compas_rhino.conversions import plane_to_compas_frame
from compas_rhino import unload_modules

# === Setup modules path ===
path = ghenv.Component.OnPingDocument().FilePath
parentdir = os.path.dirname(path)
script_dir = os.path.join(parentdir, 'scripts')
if script_dir not in sys.path:
    sys.path.append(script_dir)

unload_modules("bridge")
unload_modules("Sticks")

from bridge import GrowTowards
from Sticks import Stick

# === PARAMETERS (expose as GH inputs if desired) ===
stick_length = 200.0
stick_width  = 13.0
stick_depth  = 13.0
min_angle     = 15    # deg
max_angle     = 165   # deg
max_distance  = 300.0  # mm
min_bridge_len = 50.0  # mm

# === Helper: unwrap a GH layer safely ===
def unwrap_layer(gh_layer, index=None):
    """Try to extract a list of COMPAS Frames from a GH_ObjectWrapper or iterable layer."""
    frames = []
    try:
        # If it's a GH_ObjectWrapper, get .Value
        data = gh_layer.Value if hasattr(gh_layer, "Value") else gh_layer
        # Try to iterate
        for item in data:
            # If Rhino plane, convert to COMPAS Frame
            if hasattr(item, "Origin") and hasattr(item, "XAxis") and hasattr(item, "YAxis"):
                origin = item.Origin
                x = item.XAxis
                y = item.YAxis
                f = Frame(
                    Point(origin.X, origin.Y, origin.Z),
                    Vector(x.X, x.Y, x.Z),
                    Vector(y.X, y.Y, y.Z)
                )
                frames.append(f)
            # If already COMPAS Frame
            elif isinstance(item, Frame):
                frames.append(item)
            else:
                # Unknown type — skip
                print(f"⚠️  Layer {index}: unknown item type {type(item)} — skipping")
    except Exception as e:
        print(f"❌ unwrap_layer failed on layer {index}: {e}")
    return frames

# === Step 1: Unwrap all layers ===
print("✅ Input has", len(layered_frames), "layers")

clean_layers = []
for i, gh_layer in enumerate(layered_frames):
    layer_frames = unwrap_layer(gh_layer, i)
    print(f"  Layer {i}: {len(layer_frames)} frames unwrapped")
    clean_layers.append(layer_frames)

# === Step 2: Ensure there is at least one non‑empty layer before centroid / logic ===
all_points = [f.point for layer in clean_layers for f in layer]
if len(all_points) < 1:
    print("❌ No frame points available — abort bridging")
    geometries = []
    frames = []
    # Exit early
else:
    # Compute global center (if needed)
    try:
        center = centroid_points(all_points)
    except Exception as e:
        print(f"⚠️ centroid_points failed: {e}")
        center = None

    # === Step 3: Bridge generation with filters ===
    bridging_sticks = []

    for i in range(len(clean_layers) - 1):
        layer_a = clean_layers[i]
        layer_b = clean_layers[i + 1]

        if not layer_a or not layer_b:
            continue

        for root in layer_a:
            best = None
            best_d = float('inf')

            for target in layer_b:
                d = distance_point_point(root.point, target.point)
                if d > max_distance:
                    continue
                if d < best_d:
                    best = target
                    best_d = d

            if not best:
                continue

            bridge = GrowTowards(
                root, best,
                offset_root_child=0.0,
                offset_target_child=0.0,
                stick_length=stick_length,
                width=stick_width,
                depth=stick_depth
            )

            angle = getattr(bridge, "normal_deviation", None)
            if angle is None or angle < min_angle or angle > max_angle:
                continue

            # Check length of resulting stick(s)
            for s in bridge.sticks:
                try:
                    length = s.axis.length
                except Exception:
                    length = None
                if length is not None and length < min_bridge_len:
                    continue
                bridging_sticks.append(s)

    print("✅ Bridging produced", len(bridging_sticks), "sticks")

    # === Deduplicate (optional) ===
    unique = []
    tol = 1e-3
    for s in bridging_sticks:
        a0 = s.axis.start
        a1 = s.axis.end
        dup = False
        for u in unique:
            if (distance_point_point(a0, u.axis.start) < tol and
                distance_point_point(a1, u.axis.end)   < tol):
                dup = True
                break
        if not dup:
            unique.append(s)

    print("✅ After deduplication:", len(unique), "bridges")

    # === Output ===
    geometries = [s.geometry for s in unique]
    frames = [s.frame for s in unique if hasattr(s, "frame")]
# ---------- end bridging ----------
draw_2 = COMPASDraw(cg=branching.geometries)  # -> rg; same code as compas_draw

# ---- group: Surface_to_Brep_for_Random_Points
height_subdiv = Slider(14, range=0..30)  # disabled
layer_height = Slider(0, range=0..30)  # disabled
randomness = Slider(1, range=0..1)  # disabled
twist_angle = Slider(0, range=0..90)  # disabled
point_density = Slider(100, range=0..100)  # disabled
max_height = Slider(1000, range=0..1000)  # disabled
srf = Surface(<surface referenced from the Rhino model>)  # disabled
crv_2 = Curve(<curve referenced from the Rhino model>)  # disabled
brep_for_random_points = Python3Script(
    srf_input=srf,
    curve_input=crv_2,
    height_subdiv=height_subdiv,
    point_density=point_density,
    max_height=max_height,
    layer_height=layer_height,
    randomness=randomness,
    twist_angle=twist_angle)  # -> out, list_pts, srf_out; inputs srf_input: Surface, curve_input: Curve, height_subdiv: Int32, point_density: Int32, max_height: Int32, layer_height: Int32, randomness: Double; disabled
# ---------- brep_for_random_points: Python ----------
import Rhino.Geometry as rg
import random, math


# - If a curve is provided -> extrusion + layer logic
# - If a surface/Brep is provided -> UV sampling (Z-height ignored)

#rotate a point around centroid by ang_rad

def rotate_point_z(pt, cx, cy, ang_rad):
    dx = pt.X - cx
    dy = pt.Y - cy
    ca = math.cos(ang_rad)
    sa = math.sin(ang_rad)
    x = cx + dx * ca - dy * sa
    y = cy + dx * sa + dy * ca
    return rg.Point3d(x, y, pt.Z)

# CURVE INPUT

if curve_input is not None and srf_input is None:
    
    # 1. Create vertical extrusion surface
    z_dir = rg.Vector3d(0,0,1)
    surface = rg.Surface.CreateExtrusion(curve_input, z_dir * max_height)
    
    if not surface:
        raise Exception("Failed to extrude curve_input.")

    brep = surface.ToBrep()
    face = brep.Faces[0]

    # Output surface
    srf_out = brep

    # UV sampling domain
    u_domain = face.Domain(0)
    v_domain = face.Domain(1)

    # Generate points layer-by-layer
    pts_all = []

    for layer in range(height_subdiv + 1):

        z = (max_height / float(height_subdiv)) * layer
        ang_rad = math.radians(twist_angle * layer)
        n = max(1, int(point_density))

        # Random UV sampling
        pts_layer = []
        for i in range(n):
            u = random.uniform(u_domain.T0, u_domain.T1)
            v = random.uniform(v_domain.T0, v_domain.T1)
            p = face.PointAt(u, v)

            pz = rg.Point3d(p.X, p.Y, z)
            pts_layer.append(pz)

        # Twist around centroid
        cx = sum(p.X for p in pts_layer) / len(pts_layer)
        cy = sum(p.Y for p in pts_layer) / len(pts_layer)
        pts_rot = [rotate_point_z(p, cx, cy, ang_rad) for p in pts_layer]

        # Sort angularly
        pts_sorted = sorted(
            pts_rot,
            key=lambda pt: math.atan2(pt.Y - cy, pt.X - cx)
        )

        pts_all.extend(pts_sorted)

    pts_out = pts_all



# IF SURFACE INPUT, UV-BASED LOGIC, HEIGHT IGNORED

elif srf_input is not None:

    # 1. Normalize input to a Brep and its first face
    if isinstance(srf_input, rg.Brep):
        brep = srf_input
    elif isinstance(srf_input, rg.Surface):
        brep = srf_input.ToBrep()
    elif isinstance(srf_input, rg.Extrusion):
        brep = srf_input.ToBrep()
    else:
        raise Exception("Unsupported srf_input type.")

    face = brep.Faces[0]
    srf_out = brep

    # 2. UV Sampling (Option 3 logic)
    u_dom = face.Domain(0)
    v_dom = face.Domain(1)

    num_points = int(point_density) * max(1, int(height_subdiv))

    pts = []
    for i in range(num_points):
        u = random.uniform(u_dom.T0, u_dom.T1)
        v = random.uniform(v_dom.T0, v_dom.T1)
        pts.append(face.PointAt(u, v))

    # 3. Sort bottom → top (Z-axis)
    pts_sorted = sorted(pts, key=lambda p: p.Z)

    # 4. Optional sequence inside each Z band: cluster points into height_subdiv groups

    clustered = []
    if height_subdiv > 0:
        zmin = min(p.Z for p in pts_sorted)
        zmax = max(p.Z for p in pts_sorted)
        zspan = zmax - zmin

        for k in range(height_subdiv + 1):
            z_lo = zmin + (zspan / height_subdiv) *  k
            z_hi = zmin + (zspan / height_subdiv) * (k+1)

            layer_pts = [p for p in pts_sorted if z_lo <= p.Z < z_hi]

            if len(layer_pts) > 2:
                cx = sum(p.X for p in layer_pts)/len(layer_pts)
                cy = sum(p.Y for p in layer_pts)/len(layer_pts)
                layer_pts = sorted(
                    layer_pts,
                    key=lambda p: math.atan2(p.Y - cy, p.X - cx)
                )

            clustered.extend(layer_pts)

        list_pts = clustered

    else:
        list_pts = pts_sorted
# ---------- end brep_for_random_points ----------
geo_5 = Geometry(brep_for_random_points.list_pts)  # disabled
geo_6 = Geometry(brep_for_random_points.srf_out)  # disabled

# ----
height_subdiv_2 = Slider(2, range=0..30)  # disabled
twist_angle_2 = Slider(11, range=0..30)  # disabled
number_slider_26 = Slider(40, range=0..100)  # disabled
angle = Slider(90, range=0..90)  # disabled
offset = Slider(37.8, range=0..100)  # disabled
max_height_2 = Slider(126, range=0..200)  # disabled
face_index = Slider(2, range=0..4)  # disabled
root_index = Slider(5, range=0..5)  # disabled
number_slider_27 = Slider(45, range=0..135)  # disabled
number_slider_28 = Slider(1, range=0..20)  # disabled
number_slider_29 = Slider(0.2, range=0..1)  # disabled
layers = Slider(80, range=0..100)  # disabled
show_branch_bridge = BooleanToggle(False)  # disabled
show_frames_axes = BooleanToggle(True)  # disabled
detect_collisions_2 = BooleanToggle(True)  # disabled
angle_rule_2 = ValueList({"-30", "0", "30", "60"}, selected="-30")  # disabled
debug_mode_2 = BooleanToggle(True)  # disabled
do_bridging_2 = BooleanToggle(True)  # disabled
face_rule_2 = ValueList({"0", "1", "2", "3"}, selected="1")  # disabled
way_planes = RemoteReceiver()  # disabled
rh_geometry_2 = Geometry(<surface referenced from the Rhino model>)  # disabled
crv_3 = Curve(<curve referenced from the Rhino model>)  # disabled
draw_3 = COMPASDraw(cg=bridging.geometries)  # -> rg; same code as compas_draw
py3_4 = Python3Script(way_planes=way_planes, root_index=root_index, face_index=face_index, angle=angle, offset=offset)  # -> out, geometries; inputs way_planes: list, face_index: Int32, angle: Double, offset: Double; disabled
# ---------- py3_4: Python ----------
# r: compas>=2.14.1
# venv: sticks

import sys
import os
import math

#get current file path
path = ghenv.Component.OnPingDocument().FilePath
print (path)
#get parent directory of the parent directory
parentdir = os.path.dirname(path)
print (parentdir)
#get src folder which contains classes
dire = os.path.join(parentdir,'scripts')
print (dire)

sys.path.append(dire)

from compas_rhino import unload_modules

unload_modules("Sticks")
unload_modules("stick_module")

import Sticks
from Sticks import Stick 
from stick_module import BranchingModule
from compas.geometry import Point, Line, Point, Vector, Frame, Rotation

stick_width = 1.0
stick_depth = 1.0

from compas_rhino.conversions import plane_to_compas_frame, frame_to_rhino_plane

# Convert way_planes input to compas
root_frames = []
for pl in way_planes:
    root_frames.append(plane_to_compas_frame(pl))


root_frames_out = []
preview_planes = []                                         # Rhino planes to preview

# Apply root_index orientation per frame 
for f in root_frames:
    f_oriented = reorient_frame_for_root(f, root_index)
    root_frames_out.append(f_oriented)
    preview_planes.append(frame_to_rhino_plane(f_oriented))  # Rhino planes to preview

# Initialize tree
trees = []
for f in root_frames:
    trees.append(BranchingModule(f, stick_length=200, width=stick_width, depth=stick_depth))

# Grow tree
for t in trees:
    t.grow_stick(face_index = face_index, angle = angle, offset = offset)
    t.grow_stick(face_index = face_index, angle = angle, offset = offset)
    t.grow_stick(face_index = face_index, angle = angle, offset = offset) 

# Visualize
geometries = []
for t in trees:
    geomet = t.visualize()          
    geometries.extend(t.visualize())
# ---------- end py3_4 ----------
brep_any_shape = Python3Script(curve_input=crv_3, pt_spacing=layers, max_height=max_height_2, height_subdiv=height_subdiv_2, twist_angle=twist_angle_2)  # -> out, list_pts; inputs curve_input: Curve, pt_spacing: Int32, max_height: Int32, height_subdiv: Int32, twist_angle: Double; disabled
# ---------- brep_any_shape: Python ----------
import Rhino.Geometry as rg
import math



list_pts = []

# define points on curve
L = curve_input.GetLength()
t_params = curve_input.DivideByLength(float(pt_spacing), True)
div_pts  = [curve_input.PointAt(t) for t in t_params] 

# curve centroid
cx = sum(p.X for p in div_pts) / len(div_pts)
cy = sum(p.Y for p in div_pts) / len(div_pts)
center = rg.Point3d(cx, cy, 0.0)

# rotation by curve centroid
def rot_at_Z (pt, ang_rad, c):
    ca = math.cos(ang_rad)
    sa = math.sin(ang_rad)
    dx = pt.X - c.X
    dy = pt.Y - c.Y
    x = c.X + (dx*ca - dy*sa)
    y = c.Y + (dx*sa + dy*ca)
    return x, y

# extrude layers in the z-direction
for each_layer in range (height_subdiv +1):
    z = max_height/height_subdiv * each_layer 
    ang_rad = math.radians(twist_angle * each_layer)

    if each_layer % 2 == 0:
        for p in div_pts:
            x, y = rot_at_Z(p, ang_rad, center)
            list_pts.append (rg.Point3d(x, y, z))
    
    else:
        
        for j in range(len(div_pts)):

            mid_pt_x = (div_pts[j]+ div_pts[(j + 1) % len(div_pts)]).X * 0.5
            mid_pt_y = (div_pts[j]+ div_pts[(j + 1) % len(div_pts)]).Y * 0.5

            x, y = rot_at_Z(rg.Point3d(mid_pt_x,mid_pt_y, 0.0), ang_rad, center)
            list_pts.append(rg.Point3d(x, y, z))
# ---------- end brep_any_shape ----------
bridged_branched_sticks_full = Python3Script(
    surface_or_curve=rh_geometry_2,
    point_density=number_slider_26,
    angle_rule=angle_rule_2,
    face_rule=face_rule_2,
    stick_angle=number_slider_27,
    offset01=number_slider_29,
    steps=number_slider_28,
    do_bridging=do_bridging_2,
    detect_collisions=detect_collisions_2,
    debug_mode=debug_mode_2,
    show_frames=show_frames_axes,
    show_axes=show_frames_axes,
    show_branch=show_branch_bridge,
    show_bridge=show_branch_bridge)  # -> out, geometries, colors, frames, sticks, dbg_root_frames, dbg_root_axes, dbg_branch_geos, dbg_bridge_geos; inputs surface_or_curve: Surface, point_density: Int32, angle_rule: String, face_rule: String, steps: Int32, do_bridging: Int32, detect_collisions: Double; disabled
# ---------- bridged_branched_sticks_full: Python ----------
"""
GH Python – RootFrames Lite Integrator
FAST + SAFE version that guarantees:
- Modules load from your real /scripts folder
- RhinoCode sandbox modules are deleted
- Preview uses axes (very lightweight)

Inputs:
    surface_or_curve : Brep/Surface or Curve
    point_density    : int
    steps            : int
    stick_angle      : float
    offset01         : float in [0,1]
    detect_collisions: bool
    do_bridging      : bool

    face_rule        : str, e.g. "0,1,2,3"
    angle_rule       : str, e.g. "0,30,-30"
    debug_mode       : bool
    lite_mode        : bool
"""

# =============================================================================
# 0. CLEAR RHINOCODE SANDBOX MODULES FIRST
# =============================================================================

import sys

mods_to_remove = [
    m for m in sys.modules
    if m.startswith("RootFrames")
    or m.startswith("branch")
    or m.startswith("stick")
    or m.startswith("bridge")
]

for m in mods_to_remove:
    print("REMOVING MODULE:", m)
    del sys.modules[m]


# =============================================================================
# 1. SETUP SCRIPT FOLDER IN sys.path BEFORE IMPORTS
# =============================================================================

import os
doc_path = ghenv.Component.OnPingDocument().FilePath
root_dir = os.path.dirname(doc_path)
scripts_dir = os.path.join(root_dir, "scripts")

if scripts_dir not in sys.path:
    sys.path.insert(0, scripts_dir)  # IMPORTANT: search disk BEFORE RhinoCode sandbox

print("sys.path[0]:", sys.path[0])


# =============================================================================
# 2. IMPORT & FORCE RELOAD FROM DISK
# =============================================================================

import importlib

import stick
import branch
import bridge
import RootFrames

importlib.reload(stick)
importlib.reload(branch)
importlib.reload(bridge)
importlib.reload(RootFrames)

from RootFrames import RootFrames

print(">>> RootFrames NOW loaded from:", RootFrames.__file__)


# =============================================================================
# 3. CLASSIFY INPUT (curve or surface)
# =============================================================================

import Rhino.Geometry as rg
from System.Drawing import Color

def classify_surface_or_curve(obj):
    if obj is None:
        raise ValueError("Nothing connected to `surface_or_curve` input.")

    if isinstance(obj, (rg.Brep, rg.Surface, rg.Extrusion, rg.RevSurface)):
        return obj, None

    if isinstance(obj, rg.Curve):
        return None, obj

    raise ValueError("Expected Brep/Surface/Curve. Got: {}".format(type(obj)))


surface, curve = classify_surface_or_curve(surface_or_curve)


# =============================================================================
# 4. CONSTRUCT ROOTFRAMES ENGINE
# =============================================================================

RF = RootFrames(
    surface=surface,
    curve=curve,
    point_density=point_density,
    stick_length=None,
    stick_width=None,
    stick_depth=None,
)


# =============================================================================
# 5. RUN PIPELINE
# =============================================================================

try:
    sticks_all = RF.run(
        steps=steps,
        stick_angle=stick_angle,
        offset01=offset01,
        detect_collisions=detect_collisions,
        do_bridging=do_bridging,
        clearance=0.0,
        face_rule=face_rule,
        angle_rule=angle_rule,
        verbose=debug_mode,   # newer version
    )
except TypeError:
    # fallback for older signature
    sticks_all = RF.run(
        steps=steps,
        stick_angle=stick_angle,
        offset01=offset01,
        detect_collisions=detect_collisions,
        do_bridging=do_bridging,
        clearance=0.0,
        face_rule=face_rule,
        angle_rule=angle_rule,
    )
except Exception as e:
    raise RuntimeError("RootFrames execution failed: {}".format(e))


# =============================================================================
# 6. LITE PREVIEW — AXES ONLY (SUPER FAST)
# =============================================================================

from compas_rhino.conversions import line_to_rhino, box_to_rhino

geometries = []

if lite_mode:
    # preview axes only
    for s in sticks_all:
        try:
            geometries.append(line_to_rhino(s.axis))
        except Exception:
            geometries.append(None)
else:
    # heavier preview (Breps)
    for s in sticks_all:
        try:
            geometries.append(box_to_rhino(s.geometry))
        except Exception:
            geometries.append(None)


# =============================================================================
# 7. COLORS (simple uniform scheme)
# =============================================================================

colors = [Color.ForestGreen] * len(geometries)


# =============================================================================
# 8. PRIMARY OUTPUTS
# =============================================================================

frames = RF.frames
sticks = sticks_all


# =============================================================================
# 9. DEBUG OUTPUTS (optional, lightweight)
# =============================================================================

dbg_root_frames = RF.frames if debug_mode else []
dbg_root_axes   = []
dbg_branch_geos = []
dbg_bridge_geos = []

if debug_mode:

    # ROOT AXES
    if getattr(RF, "root_sticks", None):
        for s in RF.root_sticks:
            try:
                dbg_root_axes.append(line_to_rhino(s.axis))
            except:
                pass

    # BRANCH GEOMETRIES
    if getattr(RF, "branch_sticks", None):
        for s in RF.branch_sticks:
            try:
                dbg_branch_geos.append(
                    line_to_rhino(s.axis) if lite_mode else box_to_rhino(s.geometry)
                )
            except:
                dbg_branch_geos.append(None)

    # BRIDGE GEOMETRIES
    if getattr(RF, "bridge_sticks", None):
        for s in RF.bridge_sticks:
            try:
                dbg_bridge_geos.append(
                    line_to_rhino(s.axis) if lite_mode else box_to_rhino(s.geometry)
                )
            except:
                dbg_bridge_geos.append(None)
# ---------- end bridged_branched_sticks_full ----------
list_pts = RemoteSender(brep_any_shape.list_pts)  # disabled

# ---- group: Curve_to_Brep_for_Random_Points
twist_angle_3 = Slider(0, range=0..90)  # disabled
layer_height_2 = Slider(7, range=0..30)  # disabled
randomness_2 = Slider(0.6, range=0..1)  # disabled
height_subdiv_3 = Slider(6, range=0..30)  # disabled
point_density_2 = Slider(11, range=0..30)  # disabled
max_height_3 = Slider(78, range=0..1000)  # disabled
crv_4 = Curve(<curve referenced from the Rhino model>)  # disabled
brep_for_random_points_2 = Python3Script(
    curve_input=crv_4,
    height_subdiv=height_subdiv_3,
    point_density=point_density_2,
    max_height=max_height_3,
    layer_height=layer_height_2,
    randomness=randomness_2,
    twist_angle=twist_angle_3)  # -> out, list_pts, srf_out; inputs curve_input: Curve, height_subdiv: Int32, point_density: Int32, max_height: Int32, layer_height: Int32, randomness: Double; disabled
# ---------- brep_for_random_points_2: Python ----------
import Rhino.Geometry as rg
import random, math


z_dir = rg.Vector3d(0,0,1)
surface = rg.Surface.CreateExtrusion(curve_input, z_dir * max_height)
brep = surface.ToBrep()
face = brep.Faces[0]

# UV domains for random sampling
u_domain = face.Domain(0)
v_domain = face.Domain(1)


# Output surface for GH preview
srf_out = brep



# Rotate pts around centroid by ang_rad

def rotate_point_z(pt, cx, cy, ang_rad):
    dx = pt.X - cx
    dy = pt.Y - cy
    ca = math.cos(ang_rad)
    sa = math.sin(ang_rad)
    x = cx + dx * ca - dy * sa
    y = cy + dx * sa + dy * ca
    return rg.Point3d(x, y, pt.Z)


# Generate list points by layer

list_pts = []

for layer in range(height_subdiv + 1):

    # Height of this layer
    z = (max_height / float(height_subdiv)) * layer

    # Twist angle for this layer
    ang_rad = math.radians(twist_angle * layer)

    # Number of points in this layer
    n = max(1, int(point_density))

    # Random sample points on the surface
    
    pts_layer = []
    for i in range(n):
        u = random.uniform(u_domain.T0, u_domain.T1)
        v = random.uniform(v_domain.T0, v_domain.T1)

        # define points on surface
        p = face.PointAt(u, v)

        # orient pt per Z-dir 
        p_layer = rg.Point3d(p.X, p.Y, z)
        pts_layer.append(p_layer)

    #Twist points around layer centroid
    
    cx = sum(p.X for p in pts_layer) / len(pts_layer)
    cy = sum(p.Y for p in pts_layer) / len(pts_layer)

    pts_rotated = [rotate_point_z(p, cx, cy, ang_rad) for p in pts_layer]

    # Sort points radially within the layer to sequence correctly

    pts_sorted = sorted(
        pts_rotated,
        key=lambda p: math.atan2(p.Y - cy, p.X - cx)
    )

    # Append them to the list of points
    list_pts.extend(pts_sorted)
# ---------- end brep_for_random_points_2 ----------
list_pts_2 = RemoteReceiver([brep_for_random_points_2.list_pts, list_pts])  # disabled
geo_7 = Geometry(brep_for_random_points_2.srf_out)  # disabled
geo_8 = Geometry(list_pts_2)  # disabled

# ----
draw_4 = COMPASDraw(cg=py3_4.geometries)  # -> rg; disabled; same code as compas_draw
geo_9 = Geometry(list_pts)  # disabled
geo_10 = Geometry(bridged_branched_sticks_full.geometries)  # disabled
rot_at_tan = Slider(0, range=-90..0)  # disabled

# ---- group: Create Planes_and_their_Rotations
rot_at_tan_2 = Slider(-90, range=-90..0)  # disabled
planes_that_rotate = Python3Script(list_pts=brep_for_random_points.list_pts, rot_at_tan=rot_at_tan_2, rot_at_norm=rot_at_tan)  # -> out, way_planes; inputs list_pts: list of Point3d, rot_at_tan: Double; disabled
# ---------- planes_that_rotate: Python ----------
import Rhino.Geometry as rg
import math

#define a vector by the rel. coordinates of two consecutive points
def vec(a, b):
    return rg.Vector3d(b.X - a.X, b.Y - a.Y, b.Z - a.Z)

# set up
Z = rg.Vector3d(0, 0, 1)
way_planes = []
n = len(list_pts)

for i, pt in enumerate(list_pts):
    # estimate tangent
    if  i == 0:
        tan = vec(list_pts[0], list_pts[1])
    elif i == n - 1:
        tan = vec(list_pts[n - 2], list_pts[n - 1])
    else:
        tan = vec(list_pts[i - 1], list_pts[i + 1])

    # keep planes horizontal (about global Z)
    tan.Z = 0.0
    if not tan.Unitize():                     # guard zero-length & keeps tan to local pt coordinates
        tan = rg.Vector3d(1, 0, 0)

    norm = rg.Vector3d.CrossProduct(Z, tan)   
    if not norm.Unitize():                   # guard parallel cases
        norm = rg.Vector3d(0, 1, 0)

    # base plane
    pl = rg.Plane(pt, tan, norm)

    # rotation around tangent 
    ang_tan = math.radians(rot_at_tan)
    R_tan = rg.Transform.Rotation(ang_tan, tan, pt)
    pl.Transform(R_tan)

    # rotate the 'norm' as well, and use the updated plane
    norm_rot = rg.Vector3d(norm)
    norm_rot.Transform(R_tan)

    # then rotation around normal
    ang_norm = math.radians(rot_at_norm)
    R_norm = rg.Transform.Rotation(ang_norm, norm_rot, pt)
    pl.Transform(R_norm)

    way_planes.append(pl)
# ---------- end planes_that_rotate ----------
geo_11 = Geometry(planes_that_rotate.way_planes)  # disabled

# ----
panel_7 = Panel(bridged_branched_sticks_full.out)  # disabled
panel_8 = Panel(bridged_branched_sticks_full.dbg_root_frames)  # disabled
panel_9 = Panel(bridged_branched_sticks_full.dbg_root_axes)  # disabled
panel_10 = Panel(bridged_branched_sticks_full.dbg_bridge_geos)  # disabled
panel_11 = Panel(bridged_branched_sticks_full.dbg_branch_geos)  # disabled

number_slider_30 = Slider(2, range=0..10)  # disabled
list_pts_3 = RemoteReceiver(list_pts)  # disabled
points = PointList(Points=list_pts_3, Size=number_slider_30)  # disabled

preview = CustomPreview(Geometry=geo_10, Material=bridged_branched_sticks_full.colors)  # disabled

remote_receiver = RemoteReceiver()  # disabled
panel_12 = Panel(remote_receiver)  # disabled

root_offset_normal = Slider(0, range=0..20)  # disabled
root_offset_planar = Slider(0, range=0..20)  # disabled

# ---- group: ConvertPlanes_to_EdgeFrames&Vectors
root_offset_normal_2 = Slider(0, range=0..1000)  # disabled
root_offset_planar_2 = Slider(0, range=0..1000)  # disabled
root_index_2 = Slider(0, range=0..5)  # disabled
convert_to_compasframes = Python3Script(
    way_planes=planes_that_rotate.way_planes,
    root_index=root_index_2,
    root_offset_planar=root_offset_planar_2,
    root_offset_normal=root_offset_normal_2)  # -> out, edge_lines, edge_frames, edge_vectors; inputs way_planes: list, root_offset_planar: Double; disabled
# ---------- convert_to_compasframes: Python ----------
# r: compas>=2.14.1

import sys, os, math
import Rhino.Geometry as rg

# ------------------------------------------------------------
# Load COMPAS + conversions
# ------------------------------------------------------------
path = ghenv.Component.OnPingDocument().FilePath
parentdir = os.path.dirname(path)
scripts_dir = os.path.join(parentdir, 'scripts')
sys.path.append(scripts_dir)

from compas.geometry import (
    Frame,
    Point,
    Vector,
    Line,
    Rotation,
    Translation,
)
from compas_rhino.conversions import plane_to_compas_frame


# ------------------------------------------------------------
# Helper: rotate a base frame (same as earlier)
# ------------------------------------------------------------
def reorient_frame_for_root(f, index):
    index = int(index)
    if index == 0:
        return f

    if index == 1:
        R = Rotation.from_axis_and_angle(f.xaxis, math.radians(180), point=f.point)
    elif index == 2:
        R = Rotation.from_axis_and_angle(f.xaxis, math.radians(90), point=f.point)
    elif index == 3:
        R = Rotation.from_axis_and_angle(f.xaxis, math.radians(-90), point=f.point)
    elif index == 4:
        R = Rotation.from_axis_and_angle(f.yaxis, math.radians(90), point=f.point)
    elif index == 5:
        R = Rotation.from_axis_and_angle(f.yaxis, math.radians(-90), point=f.point)
    else:
        return f

    f2 = Frame(f.point, f.xaxis, f.yaxis)
    f2.transform(R)
    return f2


# ------------------------------------------------------------
# Helper: planar + normal offsets
# ------------------------------------------------------------
def apply_offsets(f, planar, normal):
    if planar:
        move = f.xaxis.scaled(planar) + f.yaxis.scaled(planar)
        f.transform(Translation.from_vector(move))

    if normal:
        f.transform(Translation.from_vector(f.zaxis.scaled(normal)))

    return f


# ------------------------------------------------------------
# Helper: produce a stable orthonormal frame
#   with:
#       origin = p0
#       xaxis  = direction vector (unit)
# ------------------------------------------------------------
def orthonormal_frame_from_direction(origin, xaxis):
    """Return a stable Frame(origin, x, y) with guaranteed orthonormality."""

    x = xaxis.copy()
    x.unitize()

    # Choose any non-parallel "up" vector
    worldZ = Vector(0, 0, 1)
    worldY = Vector(0, 1, 0)
    up = worldZ if abs(x.dot(worldZ)) < 0.95 else worldY

    # Construct a stable z-axis
    z = x.cross(up)
    if z.length < 1e-6:      # rare fallback
        up = Vector(1, 0, 0)
        z = x.cross(up)
    z.unitize()

    # Construct y-axis
    y = z.cross(x)
    y.unitize()

    return Frame(origin, x, y)


# ------------------------------------------------------------
# 1) Convert GH planes to frames
# ------------------------------------------------------------
frame_list = []
for pl in way_planes:
    f = plane_to_compas_frame(pl)
    f = reorient_frame_for_root(f, root_index)
    f = apply_offsets(f, root_offset_planar, root_offset_normal)
    frame_list.append(f)

# Extract points
points = [f.point for f in frame_list]
N = len(points)


# ------------------------------------------------------------
# 2) Compute nearest-neighbor connections
# ------------------------------------------------------------
edges = set()

for i in range(N):
    p_i = points[i]
    best_j = None
    best_d = 1e9

    for j in range(N):
        if i == j:
            continue
        d = p_i.distance_to_point(points[j])
        if d < best_d:
            best_d = d
            best_j = j

    if best_j is not None:
        edges.add(tuple(sorted((i, best_j))))


# ------------------------------------------------------------
# 3) Build projected vectors + orthonormal frames
# ------------------------------------------------------------
edge_vectors = []
edge_frames  = []
edge_lines   = []

for i, j in edges:
    f0 = frame_list[i]
    p0 = points[i]
    p1 = points[j]

    # step 1 — compute raw direction
    v = Vector.from_start_end(p0, p1)

    # step 2 — project onto local tangent plane (remove normal component)
    v_proj = v - f0.zaxis.scaled(v.dot(f0.zaxis))
    if v_proj.length < 1e-6:
        v_proj = f0.xaxis.copy()
    v_proj.unitize()

    # Build stable orthonormal frame
    new_f = orthonormal_frame_from_direction(p0, v_proj)

    # Save outputs
    edge_vectors.append(v_proj)
    edge_frames.append(new_f)

    # preview line for GH
    A = rg.Point3d(p0.x, p0.y, p0.z)
    B = rg.Point3d(
        p0.x + v_proj.x * 50,
        p0.y + v_proj.y * 50,
        p0.z + v_proj.z * 50
    )
    edge_lines.append(rg.Line(A, B))


# ------------------------------------------------------------
# OUTPUTS
# ------------------------------------------------------------
# Provide these to downstream code
# ---------- end convert_to_compasframes ----------
geo_12 = Geometry(convert_to_compasframes.edge_lines)  # disabled

# ----
root_index_3 = Slider(0, range=0..5)  # disabled
panel_13 = Panel(convert_to_compasframes.edge_frames)  # disabled

# ---- group: Branching Sticks
growth_steps = Slider(1, range=0..4)  # disabled
offset_2 = Slider(0.8, range=0..1)  # disabled
face_index_2 = Slider(0, range=0..4)  # disabled
angle_2 = Slider(79.4, range=0..90)  # disabled
sticks_that_grow = Python3Script(
    edge_frames=convert_to_compasframes.edge_frames,
    edge_vectors=convert_to_compasframes.edge_vectors,
    NUM_GROWTH_STEPS=growth_steps,
    face_index=face_index_2,
    angle=angle_2,
    offset=offset_2)  # -> out, geometries; inputs edge_frames: list, edge_vectors: list, NUM_GROWTH_STEPS: Int32, face_index: Int32, angle: Double, offset: Double; disabled
# ---------- sticks_that_grow: Python ----------
# r: compas>=2.14.1
# venv: sticks

import sys, os
import Rhino.Geometry as rg

from compas_rhino import unload_modules
from compas_rhino.conversions import box_to_rhino
from compas.geometry import Line


# ------------------------------------------------------------
# Load your custom scripts
# ------------------------------------------------------------
path = ghenv.Component.OnPingDocument().FilePath
parentdir = os.path.dirname(path)
scripts_dir = os.path.join(parentdir, 'scripts')
sys.path.append(scripts_dir)

unload_modules("Sticks2")
unload_modules("stick_module")

from Sticks2 import Stick
from stick_module import BranchingModule


# ------------------------------------------------------------
# GH Inputs:
#
# edge_frames      : list of COMPAS Frames
# edge_vectors     : list of COMPAS Vectors (parallel)
# NUM_GROWTH_STEPS : int
# face_index       : int 0–3
# angle            : float (deg)
# ------------------------------------------------------------


# ------------------------------------------------------------
# Validate inputs
# ------------------------------------------------------------
if not edge_frames:
    raise Exception("edge_frames input is empty.")

if not edge_vectors:
    raise Exception("edge_vectors input is empty.")

if len(edge_frames) != len(edge_vectors):
    raise Exception("edge_frames and edge_vectors must have same length.")


# ------------------------------------------------------------
# Use Stick CLASS CONSTANTS
# ------------------------------------------------------------
STICK_LEN   = Stick.LENGTH
STICK_WIDTH = Stick.WIDTH
STICK_DEPTH = Stick.DEPTH


# ------------------------------------------------------------
# MAIN LOOP
# ------------------------------------------------------------
geometries = []
trees = []

for f, v in zip(edge_frames, edge_vectors):

    # ------------------------------------------------------------------
    # 1. Construct axis aligned with GH vector
    # ------------------------------------------------------------------
    origin = f.point
    endpt = origin + v.scaled(STICK_LEN)

    axis = Line(origin, endpt)

    # ------------------------------------------------------------------
    # 2. Create the root stick (main stick)
    # ------------------------------------------------------------------
    root_stick = Stick(
        axis=axis,
        length=STICK_LEN,
        width=STICK_WIDTH,
        depth=STICK_DEPTH
    )

    # Output main stick geometry
    geometries.append(box_to_rhino(root_stick.geometry))


    # ------------------------------------------------------------------
    # 3. Build branching tree starting from THIS root stick
    # ------------------------------------------------------------------
    tree = BranchingModule(
        root_stick=root_stick,
        stick_length=STICK_LEN,
        width=STICK_WIDTH,
        depth=STICK_DEPTH
    )

    # Grow branch
    for _ in range(NUM_GROWTH_STEPS):
        tree.grow_stick(
            from_stick_index=-1,
            face_index=face_index,
            angle=angle,
            offset=offset
        )


    # Output branch geometry
    for s in tree.sticks:
        geometries.append(box_to_rhino(s.geometry))

    trees.append(tree)


# Visualize
geometries = []
for t in trees:
    geomet = t.visualize()          
    geometries.extend(t.visualize())
# ---------- end sticks_that_grow ----------
compas_draw_3 = COMPASDraw(cg=sticks_that_grow.geometries)  # -> rg; disabled; same code as compas_draw
